# Grasshopper definition AIO_python_003.gh (Grasshopper 1.0.7)

# ----
# Python
# all-in-one for dummies, John C. Shovic, Phd and Alan Simpson, 2nd Edition, 2021
# Chapter 3
# Python Elements and Syntax
# The Zen of Python
# Easter Egg
# 1. Launch VS from Anaconda Navigator and open Python 3 Workspace
# 2. View-Terminal
# 3. Type python and enter (may have to select interpreter from
# View-Command Palette, type python, click Python Select Interpreter
# choose Python 3 that came with Anaconda
# 4. Type "import this" and enter
# see list of aphorisms
# 
# The Zen of Python PEP 20
# Python enhancement proposals
# only 19 are written down, create your own #20
# 
# PEPs exist:
# www.python.org/dev/peps
# 
# PEP 8 is the Style Guide for Python Code
# readability counts
# refered to as Pycodestyle, in VS Code
# hold off on "pip install pycodestyle"
# 
# configure PyLint to help you
# 1. Choose File then choose preferences - settings
# 2. Under Search Settings, click Workspace
# 3. In Serach Settings, type pylint, select the Python>Linting: Enable option
# 4. Type pycodestyle in the Search Box
# 5. Scroll down and select the Pythonb>Linting: Pycodestyle Enabled option
# 6. Choose File-Save All or just Save
# then close the Settings page X in its tab
# 
# All settings are stored in the settings.json file
# change through this file
# Preferences-Settings, click Open Settings (JSON) icon
# near the top right.
# If Pycodestyle is too demanding, change first line to true and second line to false
# Turn off Linting with False on third line
# save and close settings.json tab
# Introducing Object-Oriented Programming
# 
# OOP
# Class is an object creator (car factory)
# Ojects are different types of cars
# 
# Discovering Why Indentations Count, Big Time
# Indentations are unique to Python
# rather than {} to indicate blocks of code
# consider JavaScript language
# not the {}, ; and ()
# 
# see first ghpython example:
# Type in your question.
panel = Panel("")

magic_8_ball = GhPythonScript(Play_Game=panel)  # -> out, input
# ---------- magic_8_ball: Python ----------
import rhinoscriptsyntax as rs
import random

if bool:
    input = random.randint(1,9)
    if input == 1:
        print("It is certain")
    elif input == 2:
        print("Outlook good")
    elif input == 3:
        print("You may rely on it")
    elif input == 4:
        print("Ask again later")
    elif input == 5:
        print("Concentrate and ask again")
    elif input == 6:
        print("Reply hazy, try again")
    elif input == 7:
        print("My repy is no")
    elif input == 8:
        print("My sources say no")
    else:
        print("That is not a question")
        
    print("Oooohhhh, ask another question mysterious man!!!")
# ---------- end magic_8_ball ----------
# Using Python Modules
panel_2 = Panel(magic_8_ball.out)
panel_3 = Panel(magic_8_ball.input)
