# Grasshopper definition AIO_python_004.gh (Grasshopper 1.0.7)

# Python
# all-in-one for dummies, John C. Shovic, Phd and Alan Simpson, 2nd Edition, 2021
# Understanding Python Data Types
# 
# Numbers must start with a digit (0-9)
# a dot (period) is a decimal point
# hyphen (-) is a negative sign
# 
# see good and bad numbers in Python
# BAD
# $1.99
# 12,345.23
# 123 234
# 234-234
# 123 Oak
# (234)345-1234
# 
# You can store information for zip codes, addresses, etc later
# occationally a j for complex numbers
# 
# Integers
# 0, -1, 999999999999
# 
# Floats
# 1.1, -1.2, 12.323
# e is power of 10
# 234e1000  scientific notation
# 
# Complex numbers
# step off the REAL number line for a bit into the IMAGINARY!
# 
# Words (strings)
# must be enclosed in ""
# "double" or 'single'
# 
# careful with quotes
# "the dog's not that mean"
# 'the dog's not that mean' (error)
# or
# 'the dog says "Woof.'
# but what about
# Mary's dog says "Woof".
# escape characters
# procede with \ backslash
# 'Mary\'s dog said "Woof".'
# or
# "Mary's dog said \"Woof\".'
# 
# also \n is newline
# "the old pond\nA frog jumped in,\nKerplunk!"
# \n is a line break
# 
# booleans
# names after George Boole
# True or False
# x = True
# or x = False
# Type sensitive
# Chapter 4
# Building You First Python Application
# 
# code a wesite, analyze data, or automate something
# 
# Python is best for creating apps, applications, or programs
# 
# must learn the language
# 
# datatypes, operators, variables
# Python language to Python syntax
# linting
# comment on code
# 
# Are you ready?
# 
# Opening the Python App File
# 1. Open Anaconda Navigator launch VS Code
# 2. File-Open Workspace from VS Code menu
# open Python 2 workspace you created in Chapter 2
# 3. Click hello.py file you created in Chapter 2
# 4. Select all the text on the first line and delete,
# start from scratch
# 
# close all other tabs X
# 
# Typing and Unsing Python Comments
comments = GhPythonScript()
# ---------- comments: Python ----------
import rhinoscriptsyntax as rs

# single comment line
"""
multi 
line
comment
these are called docstrings
they often appear at the top of 
methods, funcitons, classes, or method definitions
whick are app building blocks
single triple quotes work but they have to match at each end
"""
# single line comments are green
"""
multi line comments
are brown
"""
# ---------- end comments ----------
datatypes = GhPythonScript()  # -> out, Integers, str1, str2, str3, str4, str5, bool1, bool2
# ---------- datatypes: Python ----------
import rhinoscriptsyntax as rs

#Understanding Python Data Types
"""
Numbers must start with a digit (0-9)
a dot (period) is a decimal point
hyphen (-) is a negative sign

see good and bad numbers in Python
BAD
$1.99
12,345.23
123 234 
234-234
123 Oak
(234)345-1234

You can store information for zip codes, addresses, etc later
occationally a j for complex numbers
"""

Integers = [0, -1, 999999999999]
print(Integers)

Floats = [1.1, -1.2, 12.323]
#e is power of 10
#234e1000  scientific notation

"""
Complex numbers
step off the REAL number line for a bit into the IMAGINARY!

Words (strings)
must be enclosed in ""
"double" or 'single'

careful with quotes
"""
str1 = "the dog's not that mean"
#'the dog's not that mean' (error)
# or
str2 = 'the dog says "Woof.'
# but what about
# Mary's dog says "Woof".
# escape characters
# procede with \ backslash
str3 = 'Mary\'s dog said "Woof".'
# or 
str4 = "Mary's dog said \"Woof\"."

#also \n is newline
str5 = "the old pond\nA frog jumped in,\nKerplunk!"
# \n is a line break
"""
booleans
names after George Boole
True or False
"""
bool1 = True
# or 
bool2 = False
#Type sensitive
# ---------- end datatypes ----------
merge = Merge(
    Data1=datatypes.Integers,
    Data2=datatypes.str1,
    Data3=datatypes.str2,
    Data4=datatypes.str3,
    Data5=datatypes.str4,
    Data6=datatypes.str5,
    Data7=datatypes.bool1,
    Data8=datatypes.bool2)
panel = Panel(merge)
# Working with Python Operators
panel_2 = Panel(datatypes.out)
