# Grasshopper definition AIO_python_B1_004.gh (Grasshopper 1.0.7)

# Python
# all-in-one for dummies, John C. Shovic, Phd and Alan Simpson, 2nd Edition, 2021
# Understanding Python Data Types
# 
# Numbers must start with a digit (0-9)
# a dot (period) is a decimal point
# hyphen (-) is a negative sign
# 
# see good and bad numbers in Python
# BAD
# $1.99
# 12,345.23
# 123 234
# 234-234
# 123 Oak
# (234)345-1234
# 
# You can store information for zip codes, addresses, etc later
# occationally a j for complex numbers
# 
# Integers
# 0, -1, 999999999999
# 
# Floats
# 1.1, -1.2, 12.323
# e is power of 10
# 234e1000  scientific notation
# 
# Complex numbers
# step off the REAL number line for a bit into the IMAGINARY!
# 
# Words (strings)
# must be enclosed in ""
# "double" or 'single'
# 
# careful with quotes
# "the dog's not that mean"
# 'the dog's not that mean' (error)
# or
# 'the dog says "Woof.'
# but what about
# Mary's dog says "Woof".
# escape characters
# procede with \ backslash
# 'Mary\'s dog said "Woof".'
# or
# "Mary's dog said \"Woof\".'
# 
# also \n is newline
# "the old pond\nA frog jumped in,\nKerplunk!"
# \n is a line break
# 
# booleans
# names after George Boole
# True or False
# x = True
# or x = False
# Type sensitive
# Chapter 4
# Building You First Python Application
# 
# code a wesite, analyze data, or automate something
# 
# Python is best for creating apps, applications, or programs
# 
# must learn the language
# 
# datatypes, operators, variables
# Python language to Python syntax
# linting
# comment on code
# 
# Are you ready?
# 
# Opening the Python App File
# 1. Open Anaconda Navigator launch VS Code
# 2. File-Open Workspace from VS Code menu
# open Python 2 workspace you created in Chapter 2
# 3. Click hello.py file you created in Chapter 2
# 4. Select all the text on the first line and delete,
# start from scratch
# 
# close all other tabs X
# 
# Typing and Unsing Python Comments
comments = GhPythonScript()
# ---------- comments: Python ----------
import rhinoscriptsyntax as rs

# single comment line
"""
multi 
line
comment
these are called docstrings
they often appear at the top of 
methods, funcitons, classes, or method definitions
whick are app building blocks
single triple quotes work but they have to match at each end
"""
# single line comments are green
"""
multi line comments
are brown
"""
# ---------- end comments ----------
datatypes = GhPythonScript()  # -> out, Integers, str1, str2, str3, str4, str5, bool1, bool2
# ---------- datatypes: Python ----------
import rhinoscriptsyntax as rs

#Understanding Python Data Types
"""
Numbers must start with a digit (0-9)
a dot (period) is a decimal point
hyphen (-) is a negative sign

see good and bad numbers in Python
BAD
$1.99
12,345.23
123 234 
234-234
123 Oak
(234)345-1234

You can store information for zip codes, addresses, etc later
occationally a j for complex numbers
"""

Integers = [0, -1, 999999999999]
print(Integers)

Floats = [1.1, -1.2, 12.323]
#e is power of 10
#234e1000  scientific notation

"""
Complex numbers
step off the REAL number line for a bit into the IMAGINARY!

Words (strings)
must be enclosed in ""
"double" or 'single'

careful with quotes
"""
str1 = "the dog's not that mean"
#'the dog's not that mean' (error)
# or
str2 = 'the dog says "Woof.'
# but what about
# Mary's dog says "Woof".
# escape characters
# procede with \ backslash
str3 = 'Mary\'s dog said "Woof".'
# or 
str4 = "Mary's dog said \"Woof\"."

#also \n is newline
str5 = "the old pond\nA frog jumped in,\nKerplunk!"
# \n is a line break
"""
booleans
names after George Boole
True or False
"""
bool1 = True
# or 
bool2 = False
#Type sensitive
# ---------- end datatypes ----------
merge = Merge(
    Data1=datatypes.Integers,
    Data2=datatypes.str1,
    Data3=datatypes.str2,
    Data4=datatypes.str3,
    Data5=datatypes.str4,
    Data6=datatypes.str5,
    Data7=datatypes.bool1,
    Data8=datatypes.bool2)
panel = Panel(merge)
panel_2 = Panel(datatypes.out)
# Working with Python Operators
# 
# number, string, boolean
# use computer to operate on that information
# 
# Arithmetic operators
# [+, -, *, /, %, **, //]
# last three
# modulus, exponent, Floor Division
# 
# Comparison operators
# Python Comparison Operators
# [<, <=, >, >=, ==, !=, is, is not]
# the last two are operators, leave until later
# 
# Boolean operators
# True or False
# [ or, and, not ]
# 
# PEP 8
# recommends putting whitespace around operators
# 
# num = 10
# if num > 0:
#     print("Positive number")
# else:
#     print("Negative number")
operators = GhPythonScript()  # -> out, Arithmetic_operators, Python_Comparison_Operators, Boolean_operators
# ---------- operators: Python ----------
import rhinoscriptsyntax as rs

#Working with Python Operators

#number, string, boolean
#use computer to operate on that information

Arithmetic_operators = ["+, -, *, /, %, **, //"]
#last three
#modulus, exponent, Floor Division

#Comparison operators
Python_Comparison_Operators = ["<, <=, >, >=, ==, !=, is, is not"]
#the last two are operators, leave until later

Boolean_operators = [" or, and, not "]
#[True, False]

#PEP 8 
#recommends putting whitespace around operators

num = 10
if num > 0:
    print("Positive number")
else:
    print("Negative number")
# ---------- end operators ----------
merge_2 = Merge(Data1=operators.Arithmetic_operators, Data2=operators.Python_Comparison_Operators, Data3=operators.Boolean_operators)
# Creating and Using Variables
# 
# variable is a placeholder that may change
# literal mean the same content, variable is exactly that
# Quantity* Unit Pirce = Extended Price
# 
# Creating valid variable names
# 1. must start with letter or _
# 2. then you can use numbers, letters, _'s
# 3. case sensitive
# 4. cannot contail quotation marks
# 5. PEP * style conventions recomment lower letter and _  separaters
# 
# Camel case  adn Pascal case are commonly used
# 
# Creating variables in code
# variablename = value
# assign/store number, string or boolean
# = is an assignment operator
# x = 10
# username = "Mike"
# 
# Manipulating variables
# # This variable contains an integer
# quantiy = 10
# # This variable contains a float
# unit_price = 1.90
# # This variable contains the result of multiplying quantity times unit price
# extended_price = quantity * unit_price
# # Show the results
# print(extended_price)
# 
# Saving your work
# File- Auto Save
# File-Save
# 
# Running your Python all in VS Code
# rt click py file in tab
# choose Run Python File in Terminal
# 
# # This variable contains an integer
# quantiy = 14
# # This variable contains a float
# unit_price = 26.90
# # This variable contains the result of multiplying quantity times unit price
# extended_price = quantity * unit_price
# # Show the results
# print(extended_price)
panel_3 = Panel(operators.out)
panel_4 = Panel(merge_2)
variables = GhPythonScript(quantity=Slider(6, range=0..10), unit_price=Slider(28.68, range=0..100))  # -> out, extended_price; inputs quantity: Int32
# ---------- variables: Python ----------
import rhinoscriptsyntax as rs
"""
Creating and Using Variables

variable is a placeholder that may change
literal mean the same content, variable is exactly that
Quantity* Unit Pirce = Extended Price

Creating valid variable names
1. must start with letter or _
2. then you can use numbers, letters, _'s
3. case sensitive
4. cannot contail quotation marks
5. PEP * style conventions recomment lower letter and _  separaters

Camel case  adn Pascal case are commonly used

Creating variables in code
variablename = value
assign/store number, string or boolean
= is an assignment operator
x = 10
username = "Mike"
"""
#Manipulating variables
# This variable contains an integer
#quantiy = 10
# This variable contains a float
#unit_price = 1.90
# This variable contains the result of multiplying quantity times unit price
extended_price = quantity * unit_price
# Show the results
print(extended_price)
"""
Saving your work
File- Auto Save
File-Save

Running your Python all in VS Code
rt click py file in tab
choose Run Python File in Terminal
"""
# This variable contains an integer
#quantiy = 14
# This variable contains a float
#unit_price = 26.90
# This variable contains the result of multiplying quantity times unit price
extended_price = quantity * unit_price
# Show the results
print(extended_price)
# ---------- end variables ----------
variables_hardcoded = GhPythonScript()  # -> out, extended_price
# ---------- variables_hardcoded: Python ----------
import rhinoscriptsyntax as rs
"""
Creating and Using Variables

variable is a placeholder that may change
literal mean the same content, variable is exactly that
Quantity* Unit Pirce = Extended Price

Creating valid variable names
1. must start with letter or _
2. then you can use numbers, letters, _'s
3. case sensitive
4. cannot contail quotation marks
5. PEP * style conventions recomment lower letter and _  separaters

Camel case  adn Pascal case are commonly used

Creating variables in code
variablename = value
assign/store number, string or boolean
= is an assignment operator
x = 10
username = "Mike"
"""
#Manipulating variables
# This variable contains an integer
quantity = 10
# This variable contains a float
unit_price = 1.90
# This variable contains the result of multiplying quantity times unit price
extended_price = quantity * unit_price
# Show the results
print(extended_price)
"""
Saving your work
File- Auto Save
File-Save

Running your Python all in VS Code
rt click py file in tab
choose Run Python File in Terminal
"""
# This variable contains an integer
quantiy = 14
# This variable contains a float
unit_price = 26.90
# This variable contains the result of multiplying quantity times unit price
extended_price = quantity * unit_price
# Show the results
print(extended_price)
# ---------- end variables_hardcoded ----------
panel_5 = Panel(variables.extended_price)
panel_6 = Panel(variables_hardcoded.extended_price)
syntax = GhPythonScript()  # -> out
# ---------- syntax: Python ----------
import rhinoscriptsyntax as rs

#code blocks
x = 10
if x == 0:
    print("x is zero")
else:
    print("x is ", x)
print("All done")
# ---------- end syntax ----------
# Understanding What Syntax Is and Why It Matters
# Mary kissed John
# Jon kissed Mary
# Kissed Mary John
# 
# variablename = value
# value = variablename (doesn't work)
# similarly
# x = 10
# 10 = x (won't work either)
# 
# first_name = "Mike"
# last_name = "Wickerson"
# print(first_name, last_name)
# 
# first_name = "Mike"; last_name = "Wickerson"
# print(first_name, last_name)
# NOTE THE USE OF THE ; INSTEAD OF LINEBREAK
# 
# or
# 
# first_name = "Mike"; last_name = "Wickerson"; print(first_name, last_name)
# 
# code blocks
# x = 10
# if x == 0:
#     print("x is zero")
# else:
#     print("x is ", x)
# print("All done")
# 
# note the == and = signs
# indentation
# if/else statement
# 
# hover mouse over PEP 8 wavey line to resolve issues
# (Turn off pylint when learning, they will dirve you crazy)
panel_7 = Panel(syntax)
