# Grasshopper definition AIO_python_B2_002.gh (Grasshopper 1.0.7)

ifstatement = GhPythonScript(TorF=Toggle(True))  # -> out; inputs TorF: Boolean
# ---------- ifstatement: Python ----------
import rhinoscriptsyntax as rs

# must eliminate Python 3.0 f-string info in python 2.7
total = 100
sales_tax_rate = 0.065 
taxable = TorF
if taxable:
    print("Subtotal: " + str(total))
    sales_tax = (total * sales_tax_rate)
    print("Sales Tax: " + str(sales_tax))
    total = (total + sales_tax)
print("Total: " + str(total))
# ---------- end ifstatement ----------
panel = Panel(ifstatement)
# Ternary operations
# age = 31
# if age < 21:
#     beverage = "milk"
# elif age >= 21 and age < 80:
#     beverage = "beer"
# else:
#     beverage = "prune juice"
# 
# print("Have a " + beverage)
if_elif_else = GhPythonScript()  # -> out
# ---------- if_elif_else: Python ----------
import rhinoscriptsyntax as rs

#Ternary operations
age = 31
if age < 21:
    beverage = "milk"
elif age >= 21 and age < 80:
    beverage = "beer"
else:
    beverage = "prune juice"

print("Have a " + beverage)
# ---------- end if_elif_else ----------
# Python
# all-in-one for dummies, John C. Shovic, Phd and Alan Simpson, 2nd Edition, 2021
# Book 2
# Chapter 2
# Controlling the Action
# the doign and the action
# 
# Main Operators for Controlling the Action
# Relational operators
# Comparison operators
# 
# Python Comparison Operators for Decision-Making
# ==
# !=
# <
# >
# <=
# >=
# 
# Python Logical Operators
# and
# or not
# 
# WEB: George Boole
# if then else
# decision control
# if statement
# 
# Making Decisions with if
# 
# if contion: do this
# do this no matter what
# 
# sun = "down"
# if sun == "down": print("Good night")
# print("I am here")
# 
# == is not = (assignment)
# it is equality checking with bool outcome
# condition is true or false
# 
# sun = "up"
# if sun == "down": print("Good night")
# print("I am here")
# 
# indentation is usually PEP 8 ... 4x space
# can be any spacing so long as it is consistent in code block
# 
# if condition:
#     do this
# do this no matter what
# 
# sun = "down"
# if sun == "down":
#     print("Good night!")
# print("I am here")
# 
# i.e. Total Sale
# total = 100
# sales_tax_rate = 0.065
# taxable = True
# if taxable:
#     print(f"Subtotal : ${total:.2f}")
#     sales_tax = total * sales_tax_rate
#     print(f"Sales Tax: ${sales_tax:.2f}")
#     total = total + sales_tax
# print(f"Total      :{total:.2f}")
# 
# if taxable:
# if taxable == True:
# 
# total = 100
# sales_tax_rate = 0.065
# taxable = False
# if taxable:
#     print(f"Subtotal : ${total:.2f}")
#     sales_tax = total * sales_tax_rate
#     print(f"Sales Tax: ${sales_tax:.2f}")
#     total = total + sales_tax
# print(f"Total      :{total:.2f}")
# Hamdling multiple else statements with elif
# 
# elif statements
# 
# if condition:
#     do these indented lines of code
# elif condition:
#     do these indented lines of code
# do these un-indented lines of code no matter what
# 
# light_color = "green"
# if light_color == "green":
#     print("Go")
# elif light_color == "red":
#     print("Stop")
# else:
#     print("Proceed with caution")
# print("This code executes no matter what")
ghpython_script = GhPythonScript()  # -> out
# ---------- ghpython_script: Python ----------
import rhinoscriptsyntax as rs

import datetime as dt
# Get the current date and time
now = dt.datetime.now()
# Make a decision based on hour
if now.hour < 12:
    print("Good morning")
else:
    print("Good afternoon")
print("I hope you are doing well!")
# ---------- end ghpython_script ----------
if_elif_else2 = GhPythonScript()  # -> out
# ---------- if_elif_else2: Python ----------
import rhinoscriptsyntax as rs

light_color = "green"
if light_color == "green":
    print("Go")
elif light_color == "red":
    print("Stop")
else:
    print("Proceed with caution")
print("This code executes no matter what")
# ---------- end if_elif_else2 ----------
# Adding else to your if logic
# 
# if condition:
#     do indented lines here
# else:
#     do intended lines here
# do remaining un-dented lines no matter that
# 
# import datetime as dt
# # Get the current date and time
# now = dt.datetime.now()
# # Make a decision based on hour
# if now.hour < 12:
#     print("Good morning")
# else:
#     print("Good afternoon")
# print("I hope you are doing well!")
panel_2 = Panel(ghpython_script)
panel_3 = Panel(if_elif_else)
panel_4 = Panel(if_elif_else2)
forloop = GhPythonScript()  # -> out
# ---------- forloop: Python ----------
import rhinoscriptsyntax as rs

for x in range(7):
    print(x)
print("All done")
# ---------- end forloop ----------
forloop2 = GhPythonScript()  # -> out
# ---------- forloop2: Python ----------
import rhinoscriptsyntax as rs

for x in range(1, 10):
    print(x)
print("All done")
# ---------- end forloop2 ----------
forloopstep = GhPythonScript()  # -> out
# ---------- forloopstep: Python ----------
import rhinoscriptsyntax as rs

for x in range(1, 10, 2):
    print(x)
print("All done")
# ---------- end forloopstep ----------
# Repeating a Process with for
# 
# for loop
# 
# for x in range(y):
#     do this
#     do this
# un-indented code is executed after the loop
# 
# for x in range(7):
#     print(x)
# print("All done")
panel_5 = Panel(forloop)
panel_6 = Panel(forloop2)
panel_7 = Panel(forloopstep)
# Looping through a string
# 
# range()
# 
# for x in string:
#     do this
#     do this
# do this when the loop is done
# 
# for x in "snorkel":
#     print(x)
# print("Done")
# Looping through a list
# 
# for x in ["The", "rain", "in", "Spain"]
#     print(x)
# print("Done")
forloopstring = GhPythonScript()  # -> out
# ---------- forloopstring: Python ----------
import rhinoscriptsyntax as rs

for x in "snorkel":
    print(x)
print("Done")
# ---------- end forloopstring ----------
# Bailing out of a loop
# 
# break
# 
# for x in items:
#     if condition:
#         [do this...]
#         break
#     do this
forlooplist = GhPythonScript()  # -> out
# ---------- forlooplist: Python ----------
import rhinoscriptsyntax as rs

for x in ["The", "rain", "in", "Spain"]:
    print(x)
print("Done")
# ---------- end forlooplist ----------
forlooplist_2 = GhPythonScript()  # -> out; same code as forlooplist
panel_8 = Panel(forlooplist)
panel_9 = Panel(forlooplist_2)
panel_10 = Panel(forloopstring)
