# Grasshopper definition AIO_python_B2_003b.gh (Grasshopper 1.0.7)

# Getting the length of a list
# 
# len() function
# item -1 starts at "0"
# 
# Adding an item to the end of a list
# .append()
# students.append(new_student)
# no need to set to new variable
# this adds to the existing list students
# 
# #conditional append with if/else statement
# students = ["Oscar", "Max", "Ella"]
# student_name = "Michael"
# if student_name in students:
#     print(student_name + " already in the list")
# else:
#     students.append(student_name)
#     print(student_name + " addend to the list")
listcontains = GhPythonScript()  # -> out
# ---------- listcontains: Python ----------
import rhinoscriptsyntax as rs

students = ["Oscar", "Max", "Ella"]
# Is Ella in list?
has_Ella = "Ella" in students
print(has_Ella)
# Is Peter in list?
has_Peter = "Peter" in students
print(has_Peter)
# ---------- end listcontains ----------
conditionalappend = GhPythonScript()  # -> out
# ---------- conditionalappend: Python ----------
import rhinoscriptsyntax as rs

#conditional append with if/else statement

students = ["Oscar", "Max", "Ella"]
student_name = "Michael"
if student_name in students:
    print(student_name + " already in the list")
else:
    students.append(student_name)
    print(student_name + " addend to the list")
# ---------- end conditionalappend ----------
# Sand Box
reversesortdates = GhPythonScript()  # -> out, numbers
# ---------- reversesortdates: Python ----------
import rhinoscriptsyntax as rs

# Need this module for the dates.
import datetime as dt

# Create a list of strings
names = ["Matthew", "Mark", "Buffalo", "Tom"]
# Create a list of numbers
numbers = [ 14, 0, 56, -4, 99, 56, 11, 23]

# Create a list of dates, empty for starters
datelist = []
#Append dates one at time so code is easier to read.
datelist.append(dt.date(2020, 12, 31))
datelist.append(dt.date(2019, 1, 31))
datelist.append(dt.date(2018, 2, 28))
datelist.append(dt.date(2020, 1,1))

# Sort strings in reverse order (Z to A) and show
names.sort(reverse=True)
print(names)
print("") # This just adds a blank line to the output

#Sort numbers in reverse order (largest to smallest) and show formatted
numbers.sort(reverse=True)
print(numbers)
print("")

# sort the dates (earliest to Latest) and show formatted
datelist.sort(reverse=True)
for date in datelist:
    print(date)
    #print(f"{date:%m/%d/%y}") if using Python3
# ---------- end reversesortdates ----------
panel = Panel(listcontains)
panel_2 = Panel(conditionalappend)
panel_3 = Panel(reversesortdates.out)
panel_4 = Panel(reversesortdates.numbers)
# Removing list items
# 
# letters = ["A", "B", "item", "C", "item"]
# 
# .remove("item")
# while "item" in letters:
#     letters.remove("item")
# print(letters)
combining = GhPythonScript()  # -> out
# ---------- combining: Python ----------
import rhinoscriptsyntax as rs

list1 = [1,2,3,4,5]
list2 = [6,7,8,9]

list1.extend(list2)
print(list1)
# ---------- end combining ----------
# .pop()
# first and last and anything inbetween
# 
# letters = ["A", "B", "item", "C", "item"]
# 
# # Remove the first item.
# first_removed = letters.pop(0)
# # Remove the last item.
# last_removed = letters.pop()
# 
# # Show me the new list.
# print(letters)
# print(first_removed + " and" + last_removed + " were removed")
# it is possible to store copies of the popped items in variables
removing = GhPythonScript()  # -> out
# ---------- removing: Python ----------
import rhinoscriptsyntax as rs

letters = ["A", "B", "item", "C", "item"]

while "item" in letters:
    letters.remove("item")
print(letters)
# ---------- end removing ----------
# Changing an item in a list
# listname[index] = newvalue
# change variable value at index
# Combining lists
# original_list.extend(additional_items_list)
# list1 = [1,2,3,4,5]
# list2 = [6,7,8,9]
# 
# list1.extend(list2)
# print(list1)
changingitem = GhPythonScript()  # -> out
# ---------- changingitem: Python ----------
import rhinoscriptsyntax as rs

students = ["Oscar", "Max", "Ella"]
students[1] = "Michael"
print(students)
# ---------- end changingitem ----------
pop = GhPythonScript()  # -> out
# ---------- pop: Python ----------
import rhinoscriptsyntax as rs

letters = ["A", "B", "item", "C", "item"]

# Remove the first item.
first_removed = letters.pop(0)
# Remove the last item.
last_removed = letters.pop()

# Show me the new list.
print(letters)
print(first_removed + " and " + last_removed + " were removed")
#it is possible to store copies of the popped items in variables
# ---------- end pop ----------
# Python
# all-in-one for dummies, John C. Shovic, Phd and Alan Simpson, 2nd Edition, 2021
# Book 2
# Chapter 3
# 
# Speeding Along with Lists and Tuples
# 
# one item at a time
# Lists and Arrays
# use Jupyter Notebooks or VS Code .py files
# 
# Defining and Using Lists
# simplest data collection
# [ , , , ]
# 
# Really, Really Long Lists
# use smaller internal databases to learn
# then move onto longer external databases on the cloud
# 
# Referencing list items by position
# listname[x]
# start counting indexes/elements at 0
# 
# when reading aloud use "listname sub numbe"
# i.e. students sub [0]
# 
# beware:
# index out of range error
# 
# Looping through a list
# for x in list:
# i.e.
# for score in scores:
#     print(score)
# *note the use of prural and singular names
# 
# Seeing whether a list contains an item
# use in listname
# i.e.
# students = ["Oscar", "Max", "Ella"]
# # Is Ella in list?
# has_Ella = "Ella" in students
# print(has_Ella)
# # Is Peter in list?
# has_Peter = "Peter" in students
# print(has_Peter)
insert = GhPythonScript()  # -> out
# ---------- insert: Python ----------
import rhinoscriptsyntax as rs

students = ["Oscar", "Max", "Ella"]
student_name = "Michael"
# Add student name to front of list.
students.insert(0, student_name)
# Show me the new list.
print(students)
# ---------- end insert ----------
panel_5 = Panel(pop)
panel_6 = Panel(combining)
panel_7 = Panel(changingitem)
panel_8 = Panel(removing)
# Inserting an item into a list
# listname.insert(position, item)
# 
# students = ["Oscar", "Max", "Ella"]
# student_name = "Michael"
# # Add student name to front of list.
# students.insert(0, student_name)
# # Show me the new list.
# print(students)
panel_9 = Panel(insert)
# Finding a list item's index
# 
# listname.index(x)
# 
# error occurs if literal is not in the list
# 
# #Create a list of strings
# grades = ["A", "A", "B", "C", "D", "D", "F"]
# 
# # Find the index for "B".
# b_index = grades.index("B")
# 
# # Find the index for G
# look_for = "G"
# g_index = grades.index(look_for)
# 
# # Show the results.
# print("the first B is index " + str(b_index)
# print("The first " + look_for + " is at " + str(g_index)
countingitemtimes = GhPythonScript()  # -> out
# ---------- countingitemtimes: Python ----------
import rhinoscriptsyntax as rs

#Create a List of Strings
grades = ["A", "A", "B", "C", "D", "D", "F"]

# count the "D"'s
d_grades = grades.count("D")

#Use a variable for value of count
look_for = "C"
c_grades = grades.count("look_for")

print("There are " + str(d_grades) + " D grades in the list.")
print("There are " + str(c_grades) + " " + look_for + " grades in the lst.")
print("There are " + str(grades.count("F")) + " F grades in the list.")
# ---------- end countingitemtimes ----------
findingindex = GhPythonScript()  # -> out
# ---------- findingindex: Python ----------
import rhinoscriptsyntax as rs

#Create a list of strings
grades = ["A", "A", "B", "C", "D", "D"]

# Find the index for "B".
b_index = grades.index("B")

# Find the index for F
look_for = "F"
f_index = grades.index(look_for)

# Show the results.
print("the first B is index " + str(b_index))
print("The first " + look_for + " is at " + str(f_index))
# ---------- end findingindex ----------
# del
# 
# * new to me*
# 
# letters = ["a", "b", "c", "d", "e"]
# del letters[2]
# print(letters)
# 
# #error is item is not in list
del = GhPythonScript()  # -> out
# ---------- del: Python ----------
import rhinoscriptsyntax as rs

letters = ["a", "b", "c", "d", "e"]
del letters[2]
print(letters)

#error is item is not in list
# ---------- end del ----------

# ----
# clearing
# * NOTE not available in python 2.0
# 
# .clear() method
# for cleaqring contents only, not the list like del
# 
# letters = ["a", "b", "c", "d", "e"]
# letters.clear()
# parint(letters)
# Counting how many times an item appears in a list
# 
# listname.count(x)
# 
# use literals in quotes in list
# 
# #Create a List of Strings
# grades = ["A", "A", "B", "C", "D", "D", "F"]
# 
# # count the "D"'s
# d_brades = grades.count("D")
# 
# #Use a variable for value of count
# look_for = "C"
# c_grades = grades.count("look_for)
# 
# print("There are " + str(d_grades) + " D grades in the list.")
# print("There are " + str(c_grades) + " " + look_for + " grades in the lst.")
# print("There are " + str(grades.count("F")) + " F grades in the list.")
clearing = GhPythonScript()  # -> out
# ---------- clearing: Python ----------
import rhinoscriptsyntax as rs

#NOTE: not available in Python 2.0
letters = ["a", "b", "c", "d", "e"]
letters.clear()
print(letters)
# ---------- end clearing ----------
panel_10 = Panel(clearing)

panel_11 = Panel(countingitemtimes)
panel_12 = Panel(findingindex)
panel_13 = Panel(del)
# check out Book 2: Chapter 5 for .sort(key=lambda s: s.lower())
# 
# Dates are a little trickier
# You have to use the datetime module, they are not strings
# date()
# 
# dates = [dt.date(2020, 12, 31), dt.date(2019, 1, 31), dt.date(2018, 2, 28), dt.date(2020, 1,1)]
# 
# # Need this module for the dates.
# import datetime as dt
# 
# # Create a list of dates, empty for starters
# datelist = []
# #Append dates one at time so code is easier to read.
# datelist.append(dt.date(2020, 12, 31))
# datelist.append(dt.date(2019, 1, 31))
# datelist.append(dt.date(2018, 2, 28))
# datelist.append(dt.date(2020, 1,1))
# 
# # sort the dates (earliest to Latest) and show formatted
# datelist.sort()
# for date in datelist:
#     print(date)
#     #print(f"{date:%m/%d/%y}") if using Python3
alphabetize = GhPythonScript()  # -> out
# ---------- alphabetize: Python ----------
import rhinoscriptsyntax as rs

#sort() method
#sorted smallest to longest in strings

#listname.sort()

# Create a list of strings
names = ["Matthew", "Mark", "Buffalo", "Tom"]
# Create a list of numbers
numbers = [ 14, 0, 56, -4, 99, 56, 11, 23]

# Sort the names List.
names.sort()
# Sort the numbers List.
numbers.sort()

#Show the results
print(names)
print(numbers)
# ---------- end alphabetize ----------
sortdates = GhPythonScript()  # -> out
# ---------- sortdates: Python ----------
import rhinoscriptsyntax as rs

# Need this module for the dates.
import datetime as dt

# Create a list of dates, empty for starters
datelist = []
#Append dates one at time so code is easier to read.
datelist.append(dt.date(2020, 12, 31))
datelist.append(dt.date(2019, 1, 31))
datelist.append(dt.date(2018, 2, 28))
datelist.append(dt.date(2020, 1,1))

# sort the dates (earliest to Latest) and show formatted
datelist.sort()
for date in datelist:
    print(date)
    #print(f"{date:%m/%d/%y}") if using Python3
# ---------- end sortdates ----------
# Reverse Sort
# 
# reverse=True inside the sort()
reversesortdates_2 = GhPythonScript()  # -> out; same code as reversesortdates
# Alphabetizing and sorting lists
# 
# sort() method
# sorted smallest to longest in strings
# 
# listname.sort()
# 
# # Create a list of strings
# names = ["Matthew", "Mark", "Buffalo", "Tom"]
# # Create a list of numbers
# numbers = [ 14, 0, 56, -4, 99, 56, 11, 23]
# 
# # Sort the names List.
# names.sort()
# # Sort the numbers List.
# numbers.sort()
# 
# #Show the results
# print(names)
# print(numbers)
panel_14 = Panel(alphabetize)
panel_15 = Panel(sortdates)
panel_16 = Panel(reversesortdates_2)
# Reversing  a list
# 
# .reverse method
# 
# #Create a list of strings
# names = ["Matthew", "Mark", "Buffalo", "Tom"]
# #reverse the list
# names.reverse()
# print(names)
# Copying a list
# 
# .copy() #not in Python 2.0
# 
# #Create a list of strings
# names = ["Matthew", "Mark", "Buffalo", "Tom"]
# #Make a copy
# backward_names = names.copy()
# #reverse copy
# backward_names.reverse()
# 
# print(names)
# print(backward_names)
reversinglist = GhPythonScript()  # -> out
# ---------- reversinglist: Python ----------
import rhinoscriptsyntax as rs

#Create a list of strings
names = ["Matthew", "Mark", "Buffalo", "Tom"]
#reverse the list
names.reverse()
print(names)
# ---------- end reversinglist ----------
copylist = GhPythonScript()  # -> out
# ---------- copylist: Python ----------
import rhinoscriptsyntax as rs

# Create a list of strings
names = ["Matthew", "Mark", "Buffalo", "Tom"]
# Make a copy
#not in Python 2.0
backward_names = names.copy()
#reverse copy
backward_names.reverse()

print(names)
print(backward_names)
# ---------- end copylist ----------
# append()
# clear()
# copy()
# count()
# extend()
# index()
# insert()
# pop()
# remove()
# reverse()
# sort()
# sort(reverse=True)
# What is a Tuple and Who Cares?
# 
# Working with Sets
# 
# Then onto Dictionaries!!!
panel_17 = Panel(reversinglist)
panel_18 = Panel(copylist)
