# Grasshopper definition ghpython_ML4D2E;07;001.gh (Grasshopper 1.0.7)
# Copyright: © 2017-2018 Pierre Cuvilliers, Caitlin Mueller, Massachusetts Institute of Technology

# If you want to implement exisitng machine learning algorithms form scratch...
# 
# Knowledge of probability, linear algebra, linear programming, and multivariable calculus.
# Need to be able to translate math into working code, with sophisticated computing skills.
# 
# This will help you translate math basics into usable code.
# If you want to apply exisitng machine learning for practical purposes...
# 
# you can leverage Python software libraries using basic math and statistics.
# 
# Bayesian principles can help you to perform interesting machine learning tasks.
# Python
# Vectors, Matricies, Variables, probabilities, and their distributions
# 
# Helps to know what a mean, a median, and a standard deviation are inorder to understand
# what is going on under the hood.
# Working with Data:
# 
# Scalars, Vectors, and Matricies:
# 
# Scalar: a single base data item
# Vector: a one dimensional array [a list]
# Matrix: a two or more dimensional array, a tree/table
# 
# multidimensional arrays, tensors, not needed yet...
matrix_class = GhPythonScript()  # -> out
# ---------- matrix_class: Python ----------
__author__ = "Sculpture"
__version__ = "2022.06.04"

import rhinoscriptsyntax as rs
import scriptcontext as sc
import ghpythonremote
# Grasshopper does not recognize remote list objects as list:
from ghpythonlib.treehelpers import list_to_tree #rhino 6,7 only!

numpy = sc.sticky['numpy']
pandas = sc.sticky['pandas']
rpy = sc.sticky['rpy']
scipy = sc.sticky['scipy']
matplotlib = sc.sticky['matplotlib']
matplotlib.pyplot = sc.sticky['matplotlib.pyplot']
numpy.linalg = sc.sticky['numpy.linalg']
Queue = sc.sticky['Queue']

#algorithm
graph = {'A': ['B', 'F'],
'B': ['A', 'C'],
'C': ['B', 'D'],
'D': ['C', 'E'],
'E': ['D', 'F'],
'F': ['E', 'A']}

def find_path(graph, start, end, path=[]):
    path = path + [start]
    
    if start == end:
        print("Ending")
        return path
    
    for node in graph[start]:
        print"Checking Node ", node
    
    if node not in path:
        print"Path so far ", path
        
        newp = find_path(graph, node, end, path)
        if newp:
            return newp

find_path(graph, 'B', 'E')
#find_path(graph, 'C', 'E')

#Outputs
# ---------- end matrix_class ----------
# conda install matplotlib -n rhinoremote
# conda install pandas -n rhinoremote
# MACHINE LEARNING for Dummies
# TRANSLATED IN TO GRASSHOPPER FOR RHINO3D,
# Chapter 7: Demystifying the Math Behind Machine Learning
panel = Panel("""numpy
scipy
numpy.linalg
matplotlib
matplotlib.pyplot
pandas
Queue""")
# Learning the terminology:
# 
# To begin the process you begin by representing the
# solution to the problem as a number.
# 1-0 illness analogy
# 
# any info is a feature or a variable (statistics)
# 
# there are two types of features: quantitative and qualitative.
# 
# numbers vs words(strings)
# 
# Desicion Trees use qualitative features and are the most popular to date.
# 
# Tennis example: outlook, temp, humidity, windy (T or F)
# 
# must turn all qualitative data in to numbers
# 
# one-hot encoding
# 
# must always transformed into numbers
selection_srot = GhPythonScript()  # -> out, arr
# ---------- selection_srot: Python ----------
__author__ = "Sculpture"
__version__ = "2022.06.04"

import rhinoscriptsyntax as rs
import scriptcontext as sc
import ghpythonremote
# Grasshopper does not recognize remote list objects as list:
from ghpythonlib.treehelpers import list_to_tree #rhino 6,7 only!

numpy = sc.sticky['numpy']
pandas = sc.sticky['pandas']
rpy = sc.sticky['rpy']
scipy = sc.sticky['scipy']
matplotlib = sc.sticky['matplotlib']
matplotlib.pyplot = sc.sticky['matplotlib.pyplot']
numpy.linalg = sc.sticky['numpy.linalg']
Queue = sc.sticky['Queue']

#algorithm
arr = [9,5,7,4,2,8,1,10,6,3]
print type(arr)

def bubbleSort(arr):
    n = len(arr)
    # optimize code, so if the array is already sorted, it doesn't need
    # to go through the entire process
    swapped = False
    # Traverse through all array elements
    for i in range(n-1):
        # range(n) also work but outer loop will
        # repeat one time more than needed.
        # Last i elements are already in place
        for j in range(0, n-i-1):
 
            # traverse the array from 0 to n-i-1
            # Swap if the element found is greater
            # than the next element
            if arr[j] > arr[j + 1]:
                swapped = True
                arr[j], arr[j + 1] = arr[j + 1], arr[j]
         
        if not swapped:
            # if we haven't needed to make a single swap, we
            # can just exit the main loop.
            return

#Outputs
bubbleSort(arr)
print(arr)
# ---------- end selection_srot ----------
panel_2 = Panel(selection_srot.out)
panel_3 = Panel(selection_srot.arr)
gh_python_remote = GHPythonRemote(location="C:\Users\Sculpture\anaconda3\envs\rhinoremote", run=Toggle(True), modules=panel)  # -> out, linked_modules, rpy, import_statements
ghpython_script = GhPythonScript()  # -> Out, A
panel_4 = Panel(gh_python_remote.import_statements)
panel_5 = Panel(gh_python_remote.out)
# Numpy
# 
# Understanding scalar and vector operations
# 
# import numpy as np
# 
# size and type is important
# myshort = np.short(16) or np.int16 function
# 
# array() function
# myVect = np.array([1,2,3,4])
# myVect = np.arange(1, 10, 2) is the smae as array([1,3,5,7,9])
# myVect = np.array(np.int16([1,2,3,4])) is the same as
# array([1.,2,3,4], dtype=int16)
# 
# special type ones() function
# myVect = np.ones(4, dtype=np.int16) is the same as
# array([1,1,1,1], dtype=int16)
# and
# zeros() function to fill with "0's"
number_slider = Slider(2, range=0..10)
# Math Function Basics:
number_slider_2 = Slider(4, range=0..10)
ghpython_script_2 = GhPythonScript(a=number_slider, b=number_slider_2, c=Slider(6, range=0..10), d=Slider(9, range=0..10))  # -> out, myVectOut; inputs a: Int32, b: Int32, c: Int32, d: Int32
# ---------- ghpython_script_2: Python ----------
"""
Numpy

Understanding scalar and vector operations

import numpy as np

size and type is important
myshort = np.short(16) or np.int16 function

array() function
myVect = np.array([1,2,3,4])
myVect = np.arange(1, 10, 2) is the smae as array([1,3,5,7,9])
myVect = np.array(np.int16([1,2,3,4])) is the same as
array([1.,2,3,4], dtype=int16)

special type ones() function
myVect = np.ones(4, dtype=np.int16) is the same as
array([1,1,1,1], dtype=int16)
and 
zeros() function to fill with "0's"
"""

import rhinoscriptsyntax as rs
import scriptcontext as sc
import ghpythonremote
# Grasshopper does not recognize remote list objects as list:
from ghpythonlib.treehelpers import list_to_tree #rhino 6,7 only!
np = sc.sticky['numpy']
rpy = sc.sticky['rpy']

myVect = np.array([a,b,c,d])
print(myVect)
print(type(myVect))

myVectOut = myVect
# They need to be recovered to the local interpreter first:
myVectOut = ghpythonremote.obtain(myVectOut.tolist())
print(type(myVectOut))
myVectOut = list_to_tree(myVectOut, source=[0,0])
print(type(myVectOut))
# ---------- end ghpython_script_2 ----------
ghpython_script_3 = GhPythonScript(a=Slider(0, range=0..10), b=Slider(10, range=0..10), c=Slider(2, range=0..10), d=Slider(9, range=0..10))  # -> out, myVectOut; inputs a: Int32, b: Int32, c: Int32, d: Int32
# ---------- ghpython_script_3: Python ----------
"""
Numpy

Understanding scalar and vector operations

import numpy as np

size and type is important
myshort = np.short(16) or np.int16 function

array() function
myVect = np.array([1,2,3,4])
myVect = np.arange(1, 10, 2) is the smae as array([1,3,5,7,9])
myVect = np.array(np.int16([1,2,3,4])) is the same as
array([1.,2,3,4], dtype=int16)

special type ones() function
myVect = np.ones(4, dtype=np.int16) is the same as
array([1,1,1,1], dtype=int16)
and 
zeros() function to fill with "0's"
"""

import rhinoscriptsyntax as rs
import scriptcontext as sc
import ghpythonremote
# Grasshopper does not recognize remote list objects as list:
from ghpythonlib.treehelpers import list_to_tree #rhino 6,7 only!
np = sc.sticky['numpy']
rpy = sc.sticky['rpy']

myVect = np.array([a,b,c,d])
print(myVect)
myVect = np.array(np.int16([a,b,c,d])) 
print(myVect)
myVect = np.ones(4, dtype=np.int16)
print(myVect)
myVect = np.zeros(4, dtype=np.int16)
print(myVect)
print(type(myVect))

myVectOut = myVect
# They need to be recovered to the local interpreter first:
myVectOut = ghpythonremote.obtain(myVectOut.tolist())
print(type(myVectOut))
myVectOut = list_to_tree(myVectOut, source=[0,0])
print(type(myVectOut))
# ---------- end ghpython_script_3 ----------
panel_6 = Panel(ghpython_script_2.out)
panel_7 = Panel(ghpython_script_2.myVectOut)
panel_8 = Panel(ghpython_script_3.myVectOut)
panel_9 = Panel(ghpython_script_3.out)
# Performing Vector Multiplication:
# 
# adding, subtracting and division occurs on an element-by-element basis
# 
# however, multiplication gets a little odd...
# myVect * myVect
# and
# np.multiply(myVect, myVect)
# produce an element-by-element output array correctly
# 
# however, this can produce incorrect results with some algorithms
# 
# You need to use dot product.
# This lways works when working with vectors
# 
# Need to learn more about linear algebra for dot productand working with Matricies.
number_slider_3 = Slider(9, range=0..10)
# Logical and Comparison Tasks:
# 
# a == b
# a < b
# 
# This code checks individual elements
# and outputs type bool
# 
# You can also check
# AND, OR, XOR, and NOT
# 
# you can also use numerical inputs to these functions
# (this will come in handy for machine learning)
number_slider_4 = Slider(9, range=0..10)
# Math Functions on Vectors:
# 
# better than using loops
# i.e.
# array[1(,.2,3,4], dtype=int16)
# myVect + 1 =
# array[2,3,4,5]
# use -1
# 2 ** myVect
# numpy often reassigns a specific type to the output, even with int16
number_slider_5 = Slider(0, range=0..10)
ghpython_script_4 = GhPythonScript(a=Slider(0, range=0..10), b=Slider(10, range=0..10), c=Slider(2, range=0..10), d=number_slider_3)  # -> out, myVectOut; inputs a: Int32, b: Int32, c: Int32, d: Int32
# ---------- ghpython_script_4: Python ----------
"""
Logical and Comparison Tasks:

a == b
a < b

This code checks individual elements 
and outputs type bool

You can also check
AND, OR, XOR, and NOT

you can also use numerical inputs to these functions
(this will come in handy for machine learning)
"""

import rhinoscriptsyntax as rs
import scriptcontext as sc
import ghpythonremote
# Grasshopper does not recognize remote list objects as list:
from ghpythonlib.treehelpers import list_to_tree #rhino 6,7 only!
np = sc.sticky['numpy']
rpy = sc.sticky['rpy']

vecta = np.array([a,b,c,d])
vectb = np.array([a,c,b,d])
print(vecta)
print(vectb)
comparison = (vecta == vectb)
print(comparison)


myVectOut = comparison
# They need to be recovered to the local interpreter first:
myVectOut = ghpythonremote.obtain(myVectOut.tolist())
print(type(myVectOut))
myVectOut = list_to_tree(myVectOut, source=[0,0])
print(type(myVectOut))
# ---------- end ghpython_script_4 ----------
ghpython_script_5 = GhPythonScript(a=number_slider_5, b=Slider(10, range=0..10), c=Slider(2, range=0..10), d=number_slider_4)  # -> out, myVectOut; inputs a: Int32, b: Int32, c: Int32, d: Int32
# ---------- ghpython_script_5: Python ----------
"""
Math Functions on Vectors:

better than using loops
i.e.
array[1(,.2,3,4], dtype=int16)
myVect + 1 =
array[2,3,4,5]
use -1
2 ** myVect
numpy often reassigns a specific type to the output, even with int16
"""

import rhinoscriptsyntax as rs
import scriptcontext as sc
import ghpythonremote
# Grasshopper does not recognize remote list objects as list:
from ghpythonlib.treehelpers import list_to_tree #rhino 6,7 only!
np = sc.sticky['numpy']
rpy = sc.sticky['rpy']

myVect = np.array([a,b,c,d])
print(myVect)
myVect += 1
print(myVect)
myVect -= 5
print(myVect)
myVect = np.array([a,b,c,d])
myVect = 2 ** myVect
print(myVect)
print(type(myVect))

myVectOut = myVect
# They need to be recovered to the local interpreter first:
myVectOut = ghpythonremote.obtain(myVectOut.tolist())
print(type(myVectOut))
myVectOut = list_to_tree(myVectOut, source=[0,0])
print(type(myVectOut))
# ---------- end ghpython_script_5 ----------
ghpython_script_6 = GhPythonScript(a=Slider(0, range=0..10), b=Slider(10, range=0..10), c=Slider(2, range=0..10), d=Slider(9, range=0..10))  # -> out, myVectOut; inputs a: Int32, b: Int32, c: Int32, d: Int32; same code as ghpython_script_4
ghpython_script_7 = GhPythonScript(a=Slider(0, range=0..10), b=Slider(10, range=0..10), c=Slider(2, range=0..10), d=Slider(9, range=0..10))  # -> out, myVectOut; inputs a: Int32, b: Int32, c: Int32, d: Int32
# ---------- ghpython_script_7: Python ----------
"""
Performing Vector Multiplication:

adding, subtracting and division occurs on an element-by-element basis

however, multiplication gets a little odd...
myVect * myVect 
and  
np.multiply(myVect, myVect)
produce an element-by-element output array correctly

however, this can produce incorrect results with some algorithms

You need to use dot product.
This lways works when working with vectors

Need to learn more about linear algebra for dot productand working with Matricies.
"""

import rhinoscriptsyntax as rs
import scriptcontext as sc
import ghpythonremote
# Grasshopper does not recognize remote list objects as list:
from ghpythonlib.treehelpers import list_to_tree #rhino 6,7 only!
np = sc.sticky['numpy']
rpy = sc.sticky['rpy']

myVect = np.array([a,b,c,d])
print(myVect)
multVect = myVect * myVect
print(multVect)
multVect = np.multiply(myVect, myVect)
print(multVect)

#Outputs
myVectOut = myVect
# They need to be recovered to the local interpreter first:
myVectOut = ghpythonremote.obtain(myVectOut.tolist())
print(type(myVectOut))
myVectOut = list_to_tree(myVectOut, source=[0,0])
print(type(myVectOut))
# ---------- end ghpython_script_7 ----------
panel_10 = Panel(ghpython_script_5.myVectOut)
panel_11 = Panel(ghpython_script_4.myVectOut)
panel_12 = Panel(ghpython_script_4.out)
panel_13 = Panel(ghpython_script_5.out)
panel_14 = Panel(ghpython_script_6.myVectOut)
panel_15 = Panel(ghpython_script_6.out)
panel_16 = Panel(ghpython_script_7.myVectOut)
panel_17 = Panel(ghpython_script_7.out)

# ==== cluster GHPythonRemote: Connects the Grasshopper Python component to an external Python instance.
python = PythonScript()  # -> gh_parent_doc_dir
# ---------- python: Python ----------
from os import path

gh_parent_doc_dir = path.abspath(path.dirname(ghenv.Component.OnPingDocument().Owner.OnPingDocument().FilePath))
# ---------- end python ----------
# GH to python remote example.
# Pierre Cuvilliers, 2017-2018
# Released under the MIT license
# github.com/pilcru/ghpythonremote
# Runs and connects to an external python engine, and
# assigns imported modules to scriptcontext.sticky variables.
# 
# Arguments:
#       code (str): Path to the GH_to_python_sticky.py code file.
#       location (str): Path to a python executable, or to a folder
#             containing `python.exe`, or the name of a conda-created
#             virtual environment prefixed by `conda://` (`conda://env_name`).
#             If empty, finds python from your windows %PATH%.
#       run (boolean): Creates the connection, and imports new
#             modules, when turned to True. Kills the connection,
#             and deletes the references to the imports, when turned
#             to False.
#       modules (str list): List of module names to import in the
#             remote python. They will be added to the
#             scriptcontext.sticky dictionary, allowing them to be
#             reused from other python components in the same
#             Grasshopper document. Submodules (for example
#             `numpy.linalg` have to be added explicitly to this list
#             to be available later.
#       log_level (str from ['NOTSET', 'DEBUG', 'INFO', 'WARNING', 'ERROR', 'CRITICAL']):
#             Logging level to use for the local IronPython and the
#             remote python instance.
#       working_dir (str): Working directory for the remote python
#             instance.
# 
# Returns:
#       out (str): Console output with DEBUG information.
#       linked_modules (str list): list of imported module names.
#       rpy (rpyc connection object): The object representing the
#             remote Python interpreter.
location = ClusterInput()  # location (str): Path to a python executable, or to a folder containing `python.exe`, or the name of a conda-created virtual environment prefixed by `conda://` (`conda://env_name`). If empty, finds python from your windows %PATH%.
run = ClusterInput()  # run (boolean): Creates the connection, and imports new modules, when turned to True. Kills the connection,and deletes the references to the imports, when turned to False.
modules = ClusterInput()  # modules (str list): List of module names to import in the remote python. They will be added to the scriptcontext.sticky dictionary, allowing them to be reused from other python components in the same Grasshopper document. Submodules (for example `numpy.linalg` have to be added explicitly to this list to be available later.
list = ValueList({"CRITICAL", "ERROR", "WARNING", "INFO", "DEBUG", "NOTSET"}, selected="DEBUG")
panel = Panel(python)
ghpythonremote = GHPythonRemote(location=location, run=run, modules=modules, log_level=list, working_dir=panel)  # -> out, linked_modules, rpy; inputs run: Boolean, modules: list
# ---------- ghpythonremote: Python ----------
import inspect
import logging
from os import path
import sys
from time import sleep

import scriptcontext

import ghpythonremote
from ghpythonremote.connectors import GrasshopperToPythonRemote

local_log_level = getattr(logging, log_level, logging.WARNING)
logger = logging.getLogger("ghpythonremote")
logger.setLevel(local_log_level)
ch = logging.StreamHandler()
ch.setLevel(local_log_level)
formatter = logging.Formatter("%(levelname)s: %(name)s:\n%(message)s")
ch.setFormatter(formatter)
logger.handlers = []
logger.addHandler(ch)
logger = logging.getLogger("ghpythonremote.GH_to_python")

ROOT = path.abspath(path.dirname(inspect.getfile(ghpythonremote)))
rpyc_server_py = path.join(ROOT, "pythonservice.py")

# Set connection to CLOSED if this is the first run
# and initialize set of linked modules
try:
    remote_python_status
except NameError:
    remote_python_status = "CLOSED"
    lkd_modules = set()

# Wait for connection to connect or terminate
timer = 0
while remote_python_status == "CONNECTING" or remote_python_status == "CLOSING":
    sleep(1)
    timer += 1
    if timer == 10:
        try:
            gh2py_manager.__exit__(*sys.exc_info())
        except Exception:
            pass
        remote_python_status = "CLOSED"
        lkd_modules = set()
        raise RuntimeError(
            "Connection left in an inconsistent state and not returning. Reset "
            "everything."
        )

if run:
    if not remote_python_status == "OPEN":
        remote_python_status = "CONNECTING"
        gh2py_manager = GrasshopperToPythonRemote(
            rpyc_server_py,
            location=location,
            timeout=10,
            port=None,
            log_level=log_level,
            working_dir=working_dir,
        )
        gh2py = gh2py_manager.__enter__()
        remote_python_status = "OPEN"

    # Stuff that we can reach
    rpymod = gh2py.py_remote_modules  # A getter function for a named python module
    rpy = gh2py.connection  # Represents the remote instance root object
    scriptcontext.sticky["rpy"] = rpy
    # Add modules
    for mod in modules:
        try:
            scriptcontext.sticky[mod] = rpymod(mod)
            lkd_modules.add(mod)
        except ImportError:
            gh2py_manager.__exit__(*sys.exc_info())
            raise

elif not remote_python_status == "CLOSED":
    remote_python_status = "CLOSING"
    # Remove linked modules
    for mod in lkd_modules:
        del scriptcontext.sticky[mod]
    del scriptcontext.sticky["rpy"]
    gh2py_manager.__exit__(*sys.exc_info())
    lkd_modules = set()
    remote_python_status = "CLOSED"

# Change variable name because ghpython resets outputs to None before each run
linked_modules = lkd_modules

logger.info("GH to python connection is {}".format(remote_python_status))
# ---------- end ghpythonremote ----------
out = ClusterOutput(ghpythonremote.out)  # Console output.
linked_modules = ClusterOutput(ghpythonremote.linked_modules)  # Names of modules that were successfully added to the scriptcontext.sticky dictionary.
rpy = ClusterOutput(ghpythonremote.rpy)  # The object representing the remote python instance
python_2 = PythonScript(module_names=ghpythonremote.linked_modules)  # -> import_statements; inputs module_names: list
# ---------- python_2: Python ----------
import_statements = ["import scriptcontext as sc"]
for module_name in module_names:
    import_statements.append("{0} = sc.sticky['{0}']".format(module_name))

if len(module_names) == 0:
    import_statements = []
# ---------- end python_2 ----------
import_statements = ClusterOutput(python_2)  # Useful import statements to use the imported modules in your scripts.
