# Grasshopper definition ghpython_ML4D2E;07;001pythonb.gh (Grasshopper 1.0.7)
# Copyright: © 2017-2018 Pierre Cuvilliers, Caitlin Mueller, Massachusetts Institute of Technology

# MACHINE LEARNING for Dummies
# TRANSLATED IN TO GRASSHOPPER FOR RHINO3D,
# Chapter 4: Installing a Python Distribution
# It is essential to install ghpython remote
# on grasshopper 1.0 prior to being able to use
# the necessary python modules and libraries.
# 
# see:
# https://pypi.org/project/gh-python-remote/
# Using Anaconda for Machine Learning
# Getting Anaconda
# Defining why Anaconda is used.
# Installing Anaconda on Windows
matrix_class = GhPythonScript()  # -> out
# ---------- matrix_class: Python ----------
__author__ = "Sculpture"
__version__ = "2022.06.04"

import rhinoscriptsyntax as rs
import scriptcontext as sc
import ghpythonremote
# Grasshopper does not recognize remote list objects as list:
from ghpythonlib.treehelpers import list_to_tree #rhino 6,7 only!

numpy = sc.sticky['numpy']
pandas = sc.sticky['pandas']
rpy = sc.sticky['rpy']
scipy = sc.sticky['scipy']
matplotlib = sc.sticky['matplotlib']
matplotlib.pyplot = sc.sticky['matplotlib.pyplot']
numpy.linalg = sc.sticky['numpy.linalg']
Queue = sc.sticky['Queue']

#algorithm
graph = {'A': ['B', 'F'],
'B': ['A', 'C'],
'C': ['B', 'D'],
'D': ['C', 'E'],
'E': ['D', 'F'],
'F': ['E', 'A']}

def find_path(graph, start, end, path=[]):
    path = path + [start]
    
    if start == end:
        print("Ending")
        return path
    
    for node in graph[start]:
        print"Checking Node ", node
    
    if node not in path:
        print"Path so far ", path
        
        newp = find_path(graph, node, end, path)
        if newp:
            return newp

find_path(graph, 'B', 'E')
#find_path(graph, 'C', 'E')

#Outputs
# ---------- end matrix_class ----------

# ----
# GH Python Remote Node Setup
# conda install matplotlib -n rhinoremote
# conda install pandas -n rhinoremote
# conda install scikit-learn -n rhinoremote
panel = Panel("""numpy
scipy
numpy.linalg
matplotlib
matplotlib.pyplot
pandas
sklearn
sklearn.linear_model
sklearn.datasets
Queue""")
gh_python_remote = GHPythonRemote(location="C:\Users\Sculpture\anaconda3\envs\rhinoremote", run=Toggle(True), modules=panel)  # -> out, linked_modules, rpy, import_statements
# #conflicts with scikit.datasets and python 2.7
# conda install scikit.datasets -c conda-forge
# conda install -c conda-forge scikit-datasets
panel_2 = Panel(gh_python_remote.import_statements)
panel_3 = Panel(gh_python_remote.linked_modules)

# ----
# Downloading the Datasets
# and Example Code
# 
# Stopping the ghpython remote server
# print()
# Understanding the datasets:
# # trouble using scikit-learn datasets and python 2.7
# 
# apart from the datasets offered by Scikit-learn
# https://scikit-learn.org/stable/datasets/
# 
# we can use a number of datasets from
# https://github.com/lmassaron/datasets
print_function = GhPythonScript()  # -> out
# ---------- print_function: Python ----------
__author__ = "Sculpture"
__version__ = "2022.06.04"

import rhinoscriptsyntax as rs
import scriptcontext as sc
import ghpythonremote
# Grasshopper does not recognize remote list objects as list:
from ghpythonlib.treehelpers import list_to_tree #rhino 6,7 only!
import sys
import os

numpy = sc.sticky['numpy']
pandas = sc.sticky['pandas']
rpy = sc.sticky['rpy']
scipy = sc.sticky['scipy']
matplotlib = sc.sticky['matplotlib']
matplotlib.pyplot = sc.sticky['matplotlib.pyplot']
numpy.linalg = sc.sticky['numpy.linalg']
Queue = sc.sticky['Queue']

#algorithm
print("Python Version: ", sys.version)

result = os.popen('conda list anaconda$').read()
print('\nAnaconda Version: ', result)

#Outputs
# ---------- end print_function ----------
data_001 = GhPythonScript()  # -> out, arrayOut
# ---------- data_001: Python ----------
__author__ = "Sculpture"
__version__ = "2022.06.04"

import rhinoscriptsyntax as rs
import scriptcontext as sc
import ghpythonremote
# Grasshopper does not recognize remote list objects as list:
from ghpythonlib.treehelpers import list_to_tree #rhino 6,7 only!
import sys
import os

numpy = sc.sticky['numpy']
pandas = sc.sticky['pandas']
rpy = sc.sticky['rpy']
scipy = sc.sticky['scipy']
matplotlib = sc.sticky['matplotlib']
matplotlib.pyplot = sc.sticky['matplotlib.pyplot']
numpy.linalg = sc.sticky['numpy.linalg']
Queue = sc.sticky['Queue']
sklearn = sc.sticky['sklearn']

sklearn = sc.sticky['sklearn']
# sklearn.datasets is not working in ghpython remote ???
sklearn.datasets = sc.sticky['sklearn.datasets']

#algorithm
# Using http://lib.stat.cmu.edu/datasets/

#data_url = "http://lib.stat.cmu.edu/datasets/boston"
data_url = "http://lib.stat.cmu.edu/datasets/backache"
raw_df = pandas.read_csv(data_url, sep="\s+", skiprows=22, header=None)
data = numpy.hstack([raw_df.values[::2, :], raw_df.values[1::2, :2]])
target = raw_df.values[1::2, 2]


"""
# sklearn.datasets is not working with python 2.7
from sklearn.datasets import load_wine
data = load_wine()
data.target[[10, 80, 140]]
array([0, 1, 2])
list(data.target_names)
"""

#Outputs
#print(raw_df) 
print(target)
print type(target)
arrayOut = ghpythonremote.obtain(target.tolist())
print(type(arrayOut))
arrayOut = list_to_tree(arrayOut, source=[0,0])
print(type(arrayOut))
# ---------- end data_001 ----------
datasets = GhPythonScript()  # -> out
# ---------- datasets: Python ----------
__author__ = "Sculpture"
__version__ = "2022.06.04"

import rhinoscriptsyntax as rs
import scriptcontext as sc
import ghpythonremote
# Grasshopper does not recognize remote list objects as list:
from ghpythonlib.treehelpers import list_to_tree #rhino 6,7 only!
import sys
import os

numpy = sc.sticky['numpy']
pandas = sc.sticky['pandas']
rpy = sc.sticky['rpy']
scipy = sc.sticky['scipy']
matplotlib = sc.sticky['matplotlib']
matplotlib.pyplot = sc.sticky['matplotlib.pyplot']
numpy.linalg = sc.sticky['numpy.linalg']
Queue = sc.sticky['Queue']
sklearn = sc.sticky['sklearn']
sklearn.datasets = sc.sticky['sklearn.datasets']

#algorithm
data_url = "http://lib.stat.cmu.edu/datasets/boston"
raw_df = pandas.read_csv(data_url, sep="\s+", skiprows=22, header=None)
data = numpy.hstack([raw_df.values[::2, :], raw_df.values[1::2, :2]])
target = raw_df.values[1::2, 2]


#Outputs
print(target)
# ---------- end datasets ----------
panel_4 = Panel(print_function)
panel_5 = Panel(datasets)
panel_6 = Panel(data_001.out)
param_viewer = ParamViewer(data_001.arrayOut)
panel_7 = Panel(data_001.arrayOut)

# ==== cluster GHPythonRemote: Connects the Grasshopper Python component to an external Python instance.
python = PythonScript()  # -> gh_parent_doc_dir
# ---------- python: Python ----------
from os import path

gh_parent_doc_dir = path.abspath(path.dirname(ghenv.Component.OnPingDocument().Owner.OnPingDocument().FilePath))
# ---------- end python ----------
# GH to python remote example.
# Pierre Cuvilliers, 2017-2018
# Released under the MIT license
# github.com/pilcru/ghpythonremote
# Runs and connects to an external python engine, and
# assigns imported modules to scriptcontext.sticky variables.
# 
# Arguments:
#       code (str): Path to the GH_to_python_sticky.py code file.
#       location (str): Path to a python executable, or to a folder
#             containing `python.exe`, or the name of a conda-created
#             virtual environment prefixed by `conda://` (`conda://env_name`).
#             If empty, finds python from your windows %PATH%.
#       run (boolean): Creates the connection, and imports new
#             modules, when turned to True. Kills the connection,
#             and deletes the references to the imports, when turned
#             to False.
#       modules (str list): List of module names to import in the
#             remote python. They will be added to the
#             scriptcontext.sticky dictionary, allowing them to be
#             reused from other python components in the same
#             Grasshopper document. Submodules (for example
#             `numpy.linalg` have to be added explicitly to this list
#             to be available later.
#       log_level (str from ['NOTSET', 'DEBUG', 'INFO', 'WARNING', 'ERROR', 'CRITICAL']):
#             Logging level to use for the local IronPython and the
#             remote python instance.
#       working_dir (str): Working directory for the remote python
#             instance.
# 
# Returns:
#       out (str): Console output with DEBUG information.
#       linked_modules (str list): list of imported module names.
#       rpy (rpyc connection object): The object representing the
#             remote Python interpreter.
location = ClusterInput()  # location (str): Path to a python executable, or to a folder containing `python.exe`, or the name of a conda-created virtual environment prefixed by `conda://` (`conda://env_name`). If empty, finds python from your windows %PATH%.
run = ClusterInput()  # run (boolean): Creates the connection, and imports new modules, when turned to True. Kills the connection,and deletes the references to the imports, when turned to False.
modules = ClusterInput()  # modules (str list): List of module names to import in the remote python. They will be added to the scriptcontext.sticky dictionary, allowing them to be reused from other python components in the same Grasshopper document. Submodules (for example `numpy.linalg` have to be added explicitly to this list to be available later.
list = ValueList({"CRITICAL", "ERROR", "WARNING", "INFO", "DEBUG", "NOTSET"}, selected="DEBUG")
panel = Panel(python)
ghpythonremote = GHPythonRemote(location=location, run=run, modules=modules, log_level=list, working_dir=panel)  # -> out, linked_modules, rpy; inputs run: Boolean, modules: list
# ---------- ghpythonremote: Python ----------
import inspect
import logging
from os import path
import sys
from time import sleep

import scriptcontext

import ghpythonremote
from ghpythonremote.connectors import GrasshopperToPythonRemote

local_log_level = getattr(logging, log_level, logging.WARNING)
logger = logging.getLogger("ghpythonremote")
logger.setLevel(local_log_level)
ch = logging.StreamHandler()
ch.setLevel(local_log_level)
formatter = logging.Formatter("%(levelname)s: %(name)s:\n%(message)s")
ch.setFormatter(formatter)
logger.handlers = []
logger.addHandler(ch)
logger = logging.getLogger("ghpythonremote.GH_to_python")

ROOT = path.abspath(path.dirname(inspect.getfile(ghpythonremote)))
rpyc_server_py = path.join(ROOT, "pythonservice.py")

# Set connection to CLOSED if this is the first run
# and initialize set of linked modules
try:
    remote_python_status
except NameError:
    remote_python_status = "CLOSED"
    lkd_modules = set()

# Wait for connection to connect or terminate
timer = 0
while remote_python_status == "CONNECTING" or remote_python_status == "CLOSING":
    sleep(1)
    timer += 1
    if timer == 10:
        try:
            gh2py_manager.__exit__(*sys.exc_info())
        except Exception:
            pass
        remote_python_status = "CLOSED"
        lkd_modules = set()
        raise RuntimeError(
            "Connection left in an inconsistent state and not returning. Reset "
            "everything."
        )

if run:
    if not remote_python_status == "OPEN":
        remote_python_status = "CONNECTING"
        gh2py_manager = GrasshopperToPythonRemote(
            rpyc_server_py,
            location=location,
            timeout=10,
            port=None,
            log_level=log_level,
            working_dir=working_dir,
        )
        gh2py = gh2py_manager.__enter__()
        remote_python_status = "OPEN"

    # Stuff that we can reach
    rpymod = gh2py.py_remote_modules  # A getter function for a named python module
    rpy = gh2py.connection  # Represents the remote instance root object
    scriptcontext.sticky["rpy"] = rpy
    # Add modules
    for mod in modules:
        try:
            scriptcontext.sticky[mod] = rpymod(mod)
            lkd_modules.add(mod)
        except ImportError:
            gh2py_manager.__exit__(*sys.exc_info())
            raise

elif not remote_python_status == "CLOSED":
    remote_python_status = "CLOSING"
    # Remove linked modules
    for mod in lkd_modules:
        del scriptcontext.sticky[mod]
    del scriptcontext.sticky["rpy"]
    gh2py_manager.__exit__(*sys.exc_info())
    lkd_modules = set()
    remote_python_status = "CLOSED"

# Change variable name because ghpython resets outputs to None before each run
linked_modules = lkd_modules

logger.info("GH to python connection is {}".format(remote_python_status))
# ---------- end ghpythonremote ----------
out = ClusterOutput(ghpythonremote.out)  # Console output.
linked_modules = ClusterOutput(ghpythonremote.linked_modules)  # Names of modules that were successfully added to the scriptcontext.sticky dictionary.
rpy = ClusterOutput(ghpythonremote.rpy)  # The object representing the remote python instance
python_2 = PythonScript(module_names=ghpythonremote.linked_modules)  # -> import_statements; inputs module_names: list
# ---------- python_2: Python ----------
import_statements = ["import scriptcontext as sc"]
for module_name in module_names:
    import_statements.append("{0} = sc.sticky['{0}']".format(module_name))

if len(module_names) == 0:
    import_statements = []
# ---------- end python_2 ----------
import_statements = ClusterOutput(python_2)  # Useful import statements to use the imported modules in your scripts.
