# Grasshopper definition ghpython_ML4D2E;07;002.gh (Grasshopper 1.0.7)
# Copyright: © 2017-2018 Pierre Cuvilliers, Caitlin Mueller, Massachusetts Institute of Technology

# MACHINE LEARNING for Dummies
# TRANSLATED IN TO GRASSHOPPER FOR RHINO3D,
# Chapter 4: Installing a Python Distribution
# It is essential to install ghpython remote
# on grasshopper 1.0 prior to being able to use
# the necessary python modules and libraries.
# 
# see:
# https://pypi.org/project/gh-python-remote/
# Using Anaconda for Machine Learning
# Getting Anaconda
# Defining why Anaconda is used.
# Installing Anaconda on Windows
matrix_class = GhPythonScript()  # -> out
# ---------- matrix_class: Python ----------
__author__ = "Sculpture"
__version__ = "2022.06.04"

import rhinoscriptsyntax as rs
import scriptcontext as sc
import ghpythonremote
# Grasshopper does not recognize remote list objects as list:
from ghpythonlib.treehelpers import list_to_tree #rhino 6,7 only!

numpy = sc.sticky['numpy']
pandas = sc.sticky['pandas']
rpy = sc.sticky['rpy']
scipy = sc.sticky['scipy']
matplotlib = sc.sticky['matplotlib']
matplotlib.pyplot = sc.sticky['matplotlib.pyplot']
numpy.linalg = sc.sticky['numpy.linalg']
Queue = sc.sticky['Queue']

#algorithm
graph = {'A': ['B', 'F'],
'B': ['A', 'C'],
'C': ['B', 'D'],
'D': ['C', 'E'],
'E': ['D', 'F'],
'F': ['E', 'A']}

def find_path(graph, start, end, path=[]):
    path = path + [start]
    
    if start == end:
        print("Ending")
        return path
    
    for node in graph[start]:
        print"Checking Node ", node
    
    if node not in path:
        print"Path so far ", path
        
        newp = find_path(graph, node, end, path)
        if newp:
            return newp

find_path(graph, 'B', 'E')
#find_path(graph, 'C', 'E')

#Outputs
# ---------- end matrix_class ----------

# ----
# GH Python Remote Node Setup
# conda install matplotlib -n rhinoremote
# conda install pandas -n rhinoremote
# conda install scikit-learn -n rhinoremote
panel = Panel("""numpy
scipy
numpy.linalg
matplotlib
matplotlib.pyplot
pandas
sklearn
sklearn.linear_model
sklearn.datasets
Queue""")
gh_python_remote = GHPythonRemote(location="C:\Users\Sculpture\anaconda3\envs\rhinoremote", run=Toggle(True), modules=panel)  # -> out, linked_modules, rpy, import_statements
# #conflicts with scikit.datasets and python 2.7
# conda install scikit.datasets -c conda-forge
# conda install -c conda-forge scikit-datasets
panel_2 = Panel(gh_python_remote.import_statements)
panel_3 = Panel(gh_python_remote.linked_modules)

# ----
# Downloading the Datasets
# and Example Code
# 
# Stopping the ghpython remote server
# print()
# Understanding the datasets:
# 
# # these do not work with python 2.7
# 
# apart from the datasets offered by Scikit-learn
# https://scikit-learn.org/stable/datasets/
# 
# we can use a number of datasets from
# https://github.com/lmassaron/datasets
print_function = GhPythonScript()  # -> out
# ---------- print_function: Python ----------
__author__ = "Sculpture"
__version__ = "2022.06.04"

import rhinoscriptsyntax as rs
import scriptcontext as sc
import ghpythonremote
# Grasshopper does not recognize remote list objects as list:
from ghpythonlib.treehelpers import list_to_tree #rhino 6,7 only!
import sys
import os

numpy = sc.sticky['numpy']
pandas = sc.sticky['pandas']
rpy = sc.sticky['rpy']
scipy = sc.sticky['scipy']
matplotlib = sc.sticky['matplotlib']
matplotlib.pyplot = sc.sticky['matplotlib.pyplot']
numpy.linalg = sc.sticky['numpy.linalg']
Queue = sc.sticky['Queue']

#algorithm
print("Python Version: ", sys.version)

result = os.popen('conda list anaconda$').read()
print('\nAnaconda Version: ', result)

#Outputs
# ---------- end print_function ----------
sklearn_functions = GhPythonScript()  # -> out, arrayOut
# ---------- sklearn_functions: Python ----------
__author__ = "Sculpture"
__version__ = "2022.06.04"

import rhinoscriptsyntax as rs
import scriptcontext as sc
import ghpythonremote
# Grasshopper does not recognize remote list objects as list:
from ghpythonlib.treehelpers import list_to_tree #rhino 6,7 only!
import sys
import os

numpy = sc.sticky['numpy']
pandas = sc.sticky['pandas']
rpy = sc.sticky['rpy']
scipy = sc.sticky['scipy']
matplotlib = sc.sticky['matplotlib']
matplotlib.pyplot = sc.sticky['matplotlib.pyplot']
numpy.linalg = sc.sticky['numpy.linalg']
#Queue = sc.sticky['Queue']

sklearn = sc.sticky['sklearn']
sklearn.linear_model = sc.sticky['sklearn.linear_model']
sklearn.datasets = sc.sticky['sklearn.datasets']

#algorithm

# try this site for datasets that work and continue with what you can in ghpython remote
# http://lib.stat.cmu.edu/datasets/
data_url = "http://lib.stat.cmu.edu/datasets/boston"
data_url = "http://lib.stat.cmu.edu/datasets/backache"
raw_df = pandas.read_csv(data_url, sep="\s+", skiprows=22, header=None)
data = numpy.hstack([raw_df.values[::2, :], raw_df.values[1::2, :2]])
target = raw_df.values[1::2, 2]

#Outputs
#print(raw_df) 
print(target)
print type(target)
arrayOut = ghpythonremote.obtain(target.tolist())
print(type(arrayOut))
arrayOut = list_to_tree(arrayOut, source=[0,0])
print(type(arrayOut))
# ---------- end sklearn_functions ----------
sklearn_functions_2 = GhPythonScript()  # -> out, arrayOut
# ---------- sklearn_functions_2: Python ----------
__author__ = "Sculpture"
__version__ = "2022.06.04"

import rhinoscriptsyntax as rs
import scriptcontext as sc
import ghpythonremote
# Grasshopper does not recognize remote list objects as list:
from ghpythonlib.treehelpers import list_to_tree #rhino 6,7 only!
import sys
import os

numpy = sc.sticky['numpy']
pandas = sc.sticky['pandas']
rpy = sc.sticky['rpy']
scipy = sc.sticky['scipy']
matplotlib = sc.sticky['matplotlib']
matplotlib.pyplot = sc.sticky['matplotlib.pyplot']
numpy.linalg = sc.sticky['numpy.linalg']
#Queue = sc.sticky['Queue']

sklearn = sc.sticky['sklearn']
sklearn.linear_model = sc.sticky['sklearn.linear_model']
sklearn.datasets = sc.sticky['sklearn.datasets']

#algorithm
#data (Apple stock prices)
apple = numpy.array([1, 2, 4, 9, 16])
n = len(apple)

#oneLiner
model = sklearn.linear_model.LinearRegression().fit(numpy.arange(n).reshape((n,1)), apple)

#result
modelOut = (model.predict([[12],[13]]))
print(model.predict([[12],[13]]))
print(type(model.predict([[3],[4]])))

"""
# from sklearn import datasets
# does not work with python 2.7
from sklearn.datasets import load_wine
data = load_wine()
data.target[[10, 80, 140]]
array([0, 1, 2])
list(data.target_names)


# try this site for datasets that work and continue with what you can in ghpython remote
# http://lib.stat.cmu.edu/datasets/
data_url = "http://lib.stat.cmu.edu/datasets/boston"
raw_df = pandas.read_csv(data_url, sep="\s+", skiprows=22, header=None)
data = numpy.hstack([raw_df.values[::2, :], raw_df.values[1::2, :2]])
target = raw_df.values[1::2, 2]


#Outputs
#print(raw_df) 
print(target)
print type(target)
arrayOut = ghpythonremote.obtain(target.tolist())
print(type(arrayOut))
arrayOut = list_to_tree(arrayOut, source=[0,0])
print(type(arrayOut))
"""

print(modelOut)
print type(modelOut)
arrayOut = ghpythonremote.obtain(modelOut.tolist())
print(type(arrayOut))
arrayOut = list_to_tree(arrayOut, source=[0,0])
print(type(arrayOut))
# ---------- end sklearn_functions_2 ----------
panel_4 = Panel(print_function)
panel_5 = Panel(sklearn_functions.arrayOut)
param_viewer = ParamViewer(sklearn_functions.arrayOut)
panel_6 = Panel(sklearn_functions.out)
panel_7 = Panel(sklearn_functions_2.out)
panel_8 = Panel(sklearn_functions_2.arrayOut)
boolean = Boolean(panel_5)

construct_domain = ConstructDomain(DomainStart=Slider(3, range=0..10), DomainEnd="10")
random = Random(Range=construct_domain, Number="4", Seed=Slider(58, range=0..100))
construct_domain_2 = ConstructDomain(DomainStart=Slider(22, range=0..140), DomainEnd=Slider(95, range=0..140))
construct_domain_3 = ConstructDomain(DomainStart=Slider(11, range=0..140), DomainEnd=Slider(39, range=0..140))
jitter = Jitter(List=random, Jitter=Slider(0.25, range=0..1), Seed=Slider(57, range=0..100))  # -> graft(Values), Indices
range = Range(Domain=construct_domain_2, Steps=10)
range_2 = Range(Domain=construct_domain_3, Steps=10)
explode_tree = ExplodeTree(Data=jitter.Values)  # -> _0000, _0001, _0002, _0003
number_slider = Slider(96, range=0..100)
number_slider_2 = Slider(13, range=0..100)
random_2 = Random(Range=range, Number=explode_tree._0003, Seed=number_slider)
random_3 = Random(Range=range_2, Number=explode_tree._0000, Seed=number_slider_2)
random_4 = Random(Range=range_2, Number=explode_tree._0001, Seed=number_slider)
random_5 = Random(Range=range, Number=explode_tree._0002, Seed=number_slider_2)
plane = Plane(PlaneXY(0, 0, 0))
square = Square(Plane=plane, Size="10", ExtentX=Slider(14, range=0..50), ExtentY=Slider(14, range=0..50))  # -> simplify(Cells), simplify(Points)
masking_script = GhPythonScript(A=random_3, B=random_4, C=Slider(2, range=1..10), a=random_5, b=random_2, c=Slider(5, range=1..10))  # -> out, code; inputs A: Int32, B: Int32, C: Int32, a: Int32, b: Int32, c: Int32, d: Int32, e: Int32
# ---------- masking_script: Python ----------
__author__ = "Sculpture"
__version__ = "2022.06.18"

import rhinoscriptsyntax as rs

code = ["{", int(A/C), "to", int(B/C), "}", "[", int(a/c), "to", int(b/c), "]"]
# ---------- end masking_script ----------
param_viewer_2 = ParamViewer(square.Cells)
text_join = TextJoin(Text=masking_script.code)
panel_9 = Panel(text_join)
split_tree = SplitTree(Data=square.Points, Masks=flatten(text_join))  # -> Positive, Negative
boolean_toggle = BooleanToggle(True)
clean_tree = CleanTree(RemoveNulls=True, RemoveInvalid=True, RemoveEmpty=boolean_toggle, Tree=split_tree.Positive)
clean_tree_2 = CleanTree(RemoveNulls=True, RemoveInvalid=True, RemoveEmpty=boolean_toggle, Tree=split_tree.Positive)
cull_duplicates = CullDuplicates(Points=[clean_tree, clean_tree_2], Tolerance=0.1, CullMode=3)  # -> Points, Indices, Valence
point = Point(cull_duplicates.Points)
circle = Circle(Plane=point, Radius=Slider(10, range=0..20))
dispatch = Dispatch(List=flatten(circle), DispatchPattern=boolean)  # -> ListA, ListB
curve = Curve(dispatch.ListA)
curve_2 = Curve(dispatch.ListB)
region_union = RegionUnion(Curves=curve_2)
region_union_2 = RegionUnion(Curves=curve)
boundary_surfaces = BoundarySurfaces(Edges=region_union)
boundary_surfaces_2 = BoundarySurfaces(Edges=region_union_2)
region_difference = RegionDifference(CurvesA=region_union, CurvesB=region_union_2)
unit_z = UnitZ(Factor=Slider(4, range=0..10))
boundary_surfaces_3 = BoundarySurfaces(Edges=region_difference)
extrude = Extrude(Base=boundary_surfaces_3, Direction=unit_z)

# ----
# Numpy
# 
# Understanding scalar and vector operations
# 
# import numpy as np
# 
# size and type is important
# myshort = np.short(16) or np.int16 function
# 
# array() function
# myVect = np.array([1,2,3,4])
# myVect = np.arange(1, 10, 2) is the smae as array([1,3,5,7,9])
# myVect = np.array(np.int16([1,2,3,4])) is the same as
# array([1.,2,3,4], dtype=int16)
# 
# special type ones() function
# myVect = np.ones(4, dtype=np.int16) is the same as
# array([1,1,1,1], dtype=int16)
# and
# zeros() function to fill with "0's"
number_slider_3 = Slider(2, range=0..10)
# Math Function Basics:
number_slider_4 = Slider(4, range=0..10)
ghpython_script = GhPythonScript(a=number_slider_3, b=number_slider_4, c=Slider(6, range=0..10), d=Slider(9, range=0..10))  # -> out, myVectOut; inputs a: Int32, b: Int32, c: Int32, d: Int32
# ---------- ghpython_script: Python ----------
"""
Numpy

Understanding scalar and vector operations

import numpy as np

size and type is important
myshort = np.short(16) or np.int16 function

array() function
myVect = np.array([1,2,3,4])
myVect = np.arange(1, 10, 2) is the smae as array([1,3,5,7,9])
myVect = np.array(np.int16([1,2,3,4])) is the same as
array([1.,2,3,4], dtype=int16)

special type ones() function
myVect = np.ones(4, dtype=np.int16) is the same as
array([1,1,1,1], dtype=int16)
and 
zeros() function to fill with "0's"
"""

import rhinoscriptsyntax as rs
import scriptcontext as sc
import ghpythonremote
# Grasshopper does not recognize remote list objects as list:
from ghpythonlib.treehelpers import list_to_tree #rhino 6,7 only!
np = sc.sticky['numpy']
rpy = sc.sticky['rpy']

myVect = np.array([a,b,c,d])
print(myVect)
print(type(myVect))

myVectOut = myVect
# They need to be recovered to the local interpreter first:
myVectOut = ghpythonremote.obtain(myVectOut.tolist())
print(type(myVectOut))
myVectOut = list_to_tree(myVectOut, source=[0,0])
print(type(myVectOut))
# ---------- end ghpython_script ----------
ghpython_script_2 = GhPythonScript(a=Slider(0, range=0..10), b=Slider(10, range=0..10), c=Slider(2, range=0..10), d=Slider(9, range=0..10))  # -> out, myVectOut; inputs a: Int32, b: Int32, c: Int32, d: Int32
# ---------- ghpython_script_2: Python ----------
"""
Numpy

Understanding scalar and vector operations

import numpy as np

size and type is important
myshort = np.short(16) or np.int16 function

array() function
myVect = np.array([1,2,3,4])
myVect = np.arange(1, 10, 2) is the smae as array([1,3,5,7,9])
myVect = np.array(np.int16([1,2,3,4])) is the same as
array([1.,2,3,4], dtype=int16)

special type ones() function
myVect = np.ones(4, dtype=np.int16) is the same as
array([1,1,1,1], dtype=int16)
and 
zeros() function to fill with "0's"
"""

import rhinoscriptsyntax as rs
import scriptcontext as sc
import ghpythonremote
# Grasshopper does not recognize remote list objects as list:
from ghpythonlib.treehelpers import list_to_tree #rhino 6,7 only!
np = sc.sticky['numpy']
rpy = sc.sticky['rpy']

myVect = np.array([a,b,c,d])
print(myVect)
myVect = np.array(np.int16([a,b,c,d])) 
print(myVect)
myVect = np.ones(4, dtype=np.int16)
print(myVect)
myVect = np.zeros(4, dtype=np.int16)
print(myVect)
print(type(myVect))

myVectOut = myVect
# They need to be recovered to the local interpreter first:
myVectOut = ghpythonremote.obtain(myVectOut.tolist())
print(type(myVectOut))
myVectOut = list_to_tree(myVectOut, source=[0,0])
print(type(myVectOut))
# ---------- end ghpython_script_2 ----------
panel_10 = Panel(ghpython_script.out)
panel_11 = Panel(ghpython_script.myVectOut)
panel_12 = Panel(ghpython_script_2.myVectOut)
panel_13 = Panel(ghpython_script_2.out)
# Performing Vector Multiplication:
# 
# adding, subtracting and division occurs on an element-by-element basis
# 
# however, multiplication gets a little odd...
# myVect * myVect
# and
# np.multiply(myVect, myVect)
# produce an element-by-element output array correctly
# 
# however, this can produce incorrect results with some algorithms
# 
# You need to use dot product.
# This lways works when working with vectors
# 
# Need to learn more about linear algebra for dot productand working with Matricies.
number_slider_5 = Slider(9, range=0..10)
# Logical and Comparison Tasks:
# 
# a == b
# a < b
# 
# This code checks individual elements
# and outputs type bool
# 
# You can also check
# AND, OR, XOR, and NOT
# 
# you can also use numerical inputs to these functions
# (this will come in handy for machine learning)
number_slider_6 = Slider(9, range=0..10)
# Math Functions on Vectors:
# 
# better than using loops
# i.e.
# array[1(,.2,3,4], dtype=int16)
# myVect + 1 =
# array[2,3,4,5]
# use -1
# 2 ** myVect
# numpy often reassigns a specific type to the output, even with int16
number_slider_7 = Slider(0, range=0..10)
ghpython_script_3 = GhPythonScript(a=Slider(0, range=0..10), b=Slider(10, range=0..10), c=Slider(2, range=0..10), d=number_slider_5)  # -> out, myVectOut; inputs a: Int32, b: Int32, c: Int32, d: Int32
# ---------- ghpython_script_3: Python ----------
"""
Logical and Comparison Tasks:

a == b
a < b

This code checks individual elements 
and outputs type bool

You can also check
AND, OR, XOR, and NOT

you can also use numerical inputs to these functions
(this will come in handy for machine learning)
"""

import rhinoscriptsyntax as rs
import scriptcontext as sc
import ghpythonremote
# Grasshopper does not recognize remote list objects as list:
from ghpythonlib.treehelpers import list_to_tree #rhino 6,7 only!
np = sc.sticky['numpy']
rpy = sc.sticky['rpy']

vecta = np.array([a,b,c,d])
vectb = np.array([a,c,b,d])
print(vecta)
print(vectb)
comparison = (vecta == vectb)
print(comparison)


myVectOut = comparison
# They need to be recovered to the local interpreter first:
myVectOut = ghpythonremote.obtain(myVectOut.tolist())
print(type(myVectOut))
myVectOut = list_to_tree(myVectOut, source=[0,0])
print(type(myVectOut))
# ---------- end ghpython_script_3 ----------
ghpython_script_4 = GhPythonScript(a=number_slider_7, b=Slider(10, range=0..10), c=Slider(2, range=0..10), d=number_slider_6)  # -> out, myVectOut; inputs a: Int32, b: Int32, c: Int32, d: Int32
# ---------- ghpython_script_4: Python ----------
"""
Math Functions on Vectors:

better than using loops
i.e.
array[1(,.2,3,4], dtype=int16)
myVect + 1 =
array[2,3,4,5]
use -1
2 ** myVect
numpy often reassigns a specific type to the output, even with int16
"""

import rhinoscriptsyntax as rs
import scriptcontext as sc
import ghpythonremote
# Grasshopper does not recognize remote list objects as list:
from ghpythonlib.treehelpers import list_to_tree #rhino 6,7 only!
np = sc.sticky['numpy']
rpy = sc.sticky['rpy']

myVect = np.array([a,b,c,d])
print(myVect)
myVect += 1
print(myVect)
myVect -= 5
print(myVect)
myVect = np.array([a,b,c,d])
myVect = 2 ** myVect
print(myVect)
print(type(myVect))

myVectOut = myVect
# They need to be recovered to the local interpreter first:
myVectOut = ghpythonremote.obtain(myVectOut.tolist())
print(type(myVectOut))
myVectOut = list_to_tree(myVectOut, source=[0,0])
print(type(myVectOut))
# ---------- end ghpython_script_4 ----------
ghpython_script_5 = GhPythonScript(a=Slider(0, range=0..10), b=Slider(10, range=0..10), c=Slider(2, range=0..10), d=Slider(9, range=0..10))  # -> out, myVectOut; inputs a: Int32, b: Int32, c: Int32, d: Int32; same code as ghpython_script_3
ghpython_script_6 = GhPythonScript(a=Slider(0, range=0..10), b=Slider(10, range=0..10), c=Slider(2, range=0..10), d=Slider(9, range=0..10))  # -> out, myVectOut; inputs a: Int32, b: Int32, c: Int32, d: Int32
# ---------- ghpython_script_6: Python ----------
"""
Performing Vector Multiplication:

adding, subtracting and division occurs on an element-by-element basis

however, multiplication gets a little odd...
myVect * myVect 
and  
np.multiply(myVect, myVect)
produce an element-by-element output array correctly

however, this can produce incorrect results with some algorithms

You need to use dot product.
This lways works when working with vectors

Need to learn more about linear algebra for dot productand working with Matricies.
"""

import rhinoscriptsyntax as rs
import scriptcontext as sc
import ghpythonremote
# Grasshopper does not recognize remote list objects as list:
from ghpythonlib.treehelpers import list_to_tree #rhino 6,7 only!
np = sc.sticky['numpy']
rpy = sc.sticky['rpy']

myVect = np.array([a,b,c,d])
print(myVect)
multVect = myVect * myVect
print(multVect)
multVect = np.multiply(myVect, myVect)
print(multVect)

#Outputs
myVectOut = myVect
# They need to be recovered to the local interpreter first:
myVectOut = ghpythonremote.obtain(myVectOut.tolist())
print(type(myVectOut))
myVectOut = list_to_tree(myVectOut, source=[0,0])
print(type(myVectOut))
# ---------- end ghpython_script_6 ----------
panel_14 = Panel(ghpython_script_4.myVectOut)
panel_15 = Panel(ghpython_script_3.myVectOut)
panel_16 = Panel(ghpython_script_3.out)
panel_17 = Panel(ghpython_script_4.out)
panel_18 = Panel(ghpython_script_5.myVectOut)
panel_19 = Panel(ghpython_script_5.out)
panel_20 = Panel(ghpython_script_6.myVectOut)
panel_21 = Panel(ghpython_script_6.out)

# ==== cluster GHPythonRemote: Connects the Grasshopper Python component to an external Python instance.
python = PythonScript()  # -> gh_parent_doc_dir
# ---------- python: Python ----------
from os import path

gh_parent_doc_dir = path.abspath(path.dirname(ghenv.Component.OnPingDocument().Owner.OnPingDocument().FilePath))
# ---------- end python ----------
# GH to python remote example.
# Pierre Cuvilliers, 2017-2018
# Released under the MIT license
# github.com/pilcru/ghpythonremote
# Runs and connects to an external python engine, and
# assigns imported modules to scriptcontext.sticky variables.
# 
# Arguments:
#       code (str): Path to the GH_to_python_sticky.py code file.
#       location (str): Path to a python executable, or to a folder
#             containing `python.exe`, or the name of a conda-created
#             virtual environment prefixed by `conda://` (`conda://env_name`).
#             If empty, finds python from your windows %PATH%.
#       run (boolean): Creates the connection, and imports new
#             modules, when turned to True. Kills the connection,
#             and deletes the references to the imports, when turned
#             to False.
#       modules (str list): List of module names to import in the
#             remote python. They will be added to the
#             scriptcontext.sticky dictionary, allowing them to be
#             reused from other python components in the same
#             Grasshopper document. Submodules (for example
#             `numpy.linalg` have to be added explicitly to this list
#             to be available later.
#       log_level (str from ['NOTSET', 'DEBUG', 'INFO', 'WARNING', 'ERROR', 'CRITICAL']):
#             Logging level to use for the local IronPython and the
#             remote python instance.
#       working_dir (str): Working directory for the remote python
#             instance.
# 
# Returns:
#       out (str): Console output with DEBUG information.
#       linked_modules (str list): list of imported module names.
#       rpy (rpyc connection object): The object representing the
#             remote Python interpreter.
location = ClusterInput()  # location (str): Path to a python executable, or to a folder containing `python.exe`, or the name of a conda-created virtual environment prefixed by `conda://` (`conda://env_name`). If empty, finds python from your windows %PATH%.
run = ClusterInput()  # run (boolean): Creates the connection, and imports new modules, when turned to True. Kills the connection,and deletes the references to the imports, when turned to False.
modules = ClusterInput()  # modules (str list): List of module names to import in the remote python. They will be added to the scriptcontext.sticky dictionary, allowing them to be reused from other python components in the same Grasshopper document. Submodules (for example `numpy.linalg` have to be added explicitly to this list to be available later.
list = ValueList({"CRITICAL", "ERROR", "WARNING", "INFO", "DEBUG", "NOTSET"}, selected="DEBUG")
panel = Panel(python)
ghpythonremote = GHPythonRemote(location=location, run=run, modules=modules, log_level=list, working_dir=panel)  # -> out, linked_modules, rpy; inputs run: Boolean, modules: list
# ---------- ghpythonremote: Python ----------
import inspect
import logging
from os import path
import sys
from time import sleep

import scriptcontext

import ghpythonremote
from ghpythonremote.connectors import GrasshopperToPythonRemote

local_log_level = getattr(logging, log_level, logging.WARNING)
logger = logging.getLogger("ghpythonremote")
logger.setLevel(local_log_level)
ch = logging.StreamHandler()
ch.setLevel(local_log_level)
formatter = logging.Formatter("%(levelname)s: %(name)s:\n%(message)s")
ch.setFormatter(formatter)
logger.handlers = []
logger.addHandler(ch)
logger = logging.getLogger("ghpythonremote.GH_to_python")

ROOT = path.abspath(path.dirname(inspect.getfile(ghpythonremote)))
rpyc_server_py = path.join(ROOT, "pythonservice.py")

# Set connection to CLOSED if this is the first run
# and initialize set of linked modules
try:
    remote_python_status
except NameError:
    remote_python_status = "CLOSED"
    lkd_modules = set()

# Wait for connection to connect or terminate
timer = 0
while remote_python_status == "CONNECTING" or remote_python_status == "CLOSING":
    sleep(1)
    timer += 1
    if timer == 10:
        try:
            gh2py_manager.__exit__(*sys.exc_info())
        except Exception:
            pass
        remote_python_status = "CLOSED"
        lkd_modules = set()
        raise RuntimeError(
            "Connection left in an inconsistent state and not returning. Reset "
            "everything."
        )

if run:
    if not remote_python_status == "OPEN":
        remote_python_status = "CONNECTING"
        gh2py_manager = GrasshopperToPythonRemote(
            rpyc_server_py,
            location=location,
            timeout=10,
            port=None,
            log_level=log_level,
            working_dir=working_dir,
        )
        gh2py = gh2py_manager.__enter__()
        remote_python_status = "OPEN"

    # Stuff that we can reach
    rpymod = gh2py.py_remote_modules  # A getter function for a named python module
    rpy = gh2py.connection  # Represents the remote instance root object
    scriptcontext.sticky["rpy"] = rpy
    # Add modules
    for mod in modules:
        try:
            scriptcontext.sticky[mod] = rpymod(mod)
            lkd_modules.add(mod)
        except ImportError:
            gh2py_manager.__exit__(*sys.exc_info())
            raise

elif not remote_python_status == "CLOSED":
    remote_python_status = "CLOSING"
    # Remove linked modules
    for mod in lkd_modules:
        del scriptcontext.sticky[mod]
    del scriptcontext.sticky["rpy"]
    gh2py_manager.__exit__(*sys.exc_info())
    lkd_modules = set()
    remote_python_status = "CLOSED"

# Change variable name because ghpython resets outputs to None before each run
linked_modules = lkd_modules

logger.info("GH to python connection is {}".format(remote_python_status))
# ---------- end ghpythonremote ----------
out = ClusterOutput(ghpythonremote.out)  # Console output.
linked_modules = ClusterOutput(ghpythonremote.linked_modules)  # Names of modules that were successfully added to the scriptcontext.sticky dictionary.
rpy = ClusterOutput(ghpythonremote.rpy)  # The object representing the remote python instance
python_2 = PythonScript(module_names=ghpythonremote.linked_modules)  # -> import_statements; inputs module_names: list
# ---------- python_2: Python ----------
import_statements = ["import scriptcontext as sc"]
for module_name in module_names:
    import_statements.append("{0} = sc.sticky['{0}']".format(module_name))

if len(module_names) == 0:
    import_statements = []
# ---------- end python_2 ----------
import_statements = ClusterOutput(python_2)  # Useful import statements to use the imported modules in your scripts.
